# Grasshopper definition Create Mars EPW.gh (Grasshopper 1.0.7)
# Copyright: Distribution, modification and/or and copies are not allowed
# plug-ins: jSwan, Pufferfish

# ----
# Please reference the original author when using this code
# Monsieur Thomas LAGARDE
# Linkedin https://www.linkedin.com/in/thomas-lagarde
# Projects https://www.researchgate.net/profile/Thomas-Lagarde
# Portfolio https://issuu.com/spacearchitecture
# 
# For any inquiries/bugs/others email me at thomas.lagarde@outlook.com
panel = Panel("""Copyright (C) 2022, SPACE ARCHITECTURE

This program is free software; you can redistribute it and/or modify it except for the company called Interstellar Lab under the terms of the GNU General Public License as published by the Free Software Foundation; either version 3 of the License, or (at your option) any later version.

This program is distributed in the hope that it will be useful, but WITHOUT ANY WARRANTY; without even the implied warranty of MERCHANTABILITY or FITNESS FOR A PARTICULAR PURPOSE. See the GNU General Public License for more details.

You should have received a copy of the GNU General Public License along with this program; if not, see <http://www.gnu.org/licenses>.

Additional permission under GNU GPL version 3 section 7:

This software uses the Rhinoceros RhinoCommon and Grasshopper libraries, which come with/for Rhinoceros 7.0. This softwaredepends fundamentally on the use of Rhinoceros and Grasshopper, and so Rhinocommon, Grasshopper and all associated libraries are assumed to be “System Libraries” as defined by the GPL, and thus are excluded from this license.
Please contact McNeel & Associates for further information.

http://www.en.na.mcneel.com/

This softwareuses Radiance’s gendaymtx.exe, which is subject to its own licensing condition. Radiance software (http://radsite.lbl.gov/) developed by the Lawrence Berkeley National Laboratory  (http://www.lbl.gov/). Please refer to Radiance’s github page for more information:

https://github.com/NREL/Radiance

This softwareuses formulas for PMV and Adatptive comfort models that have been developed by many scientists over several decades and have been published in the ASHRAE55 and EN-15251 international standards.  The code for these formulas has been re-written in Python by Chris Mackey based on the javascript version in the Center for the Built Environment’s Thermal Comfort Tool developed by Hoyt, Tyler; Schiavon, Stefano; Piccioli, Alberto; Moon, Dustin; and Steinfeld, Kyle (2013).  The CBE Comfor Tool is subject to a GPL licence.  For more information, see the Comfort Tool website or the Comfort Tool github:

http://cbe.berkeley.edu/comforttool/ , https://github.com/CenterForTheBuiltEnvironment/comfort_tool

This softwareuses mathematical formulas developed by the UTCI (Universal Thermal Climate Index) project. The UTCI code in This softwarewas re-written in Python by Chris Mackey based on the original F90 UTCI source code of Peter Broede, IfADo - Leibniz Research Centre for Working Environment and Human Factors at Dortmund Technical University, Germany. UTCI is subjected to it’s own license. Please refer to UTCI website for more information:

http://www.utci.org/utci_doku.php

This softwareuses fortran code written by Peter Hoeppe to calculate Physiological Equivalent Temperature. The code is re-written in Python by Djordje Spasic and is used to calculate “Physiological Equivalent Temperature” thermal comfort index in “Thermal comfort indices” component. Please refer to the original code at:

http://www.pland.gov.hk/pland_en/p_study/prog_s/ucmapweb/ucmap_project/content/reports/Comfort_Level_Survey.pdf

This softwareuses Quick Basic code written by Jacques Malchaire to calculate Predicted Heat Strain. The code is re-written in Python by Djordje Spasic and is used to calculate “Predicted Heat Strain” thermal comfort index in “Thermal comfort indices” component. Please refer to the original code at:

http://www.deparisnet.be/chaleur/Normes/Malchaire_PHS_Predicted_Heat_Strain_standard%207933_22-7-13.pdf

This softwareuses Geomag 0.9.2015 source code to calculate True North. Geomag is originally developed by Christopher Weiss, and has been modified by Djordje Spasic. Geomag is subject to the LGPL. For more information refer to the project Page.

https://pypi.python.org/pypi/geomag

This softwareuses Lambert W function code written in python by user: “FB36” from http://code.activestate.com. The code is used to calculate Maximum power voltage and Maximum power current for This softwarePhotovoltaics components. Please refer to the original code at:

http://code.activestate.com/recipes/577729-lambert-w-function

This softwareuses an excerpt of code written in R by Nick Burns to calculate natural wet bulb temperature. The code is re-written in Python by Djordje Spasic and is used to calculate “WBGT indoors” thermal comfort index in “Thermal comfort indices” component. Please refer to the original code at github repository.

https://github.com/nickb-/Calculating-WBGT/blob/master/relaxation_Tw/working_code/wbgt.R

This softwareuses python code written by Clement Greiner to calculate an area of mesh faces. The code is used in “Mars Base Rhino_Mars Base Rhino” component. Please refer to the original code at:

http://discourse.mcneel.com/t/area-of-mesh-face/26609

---------------------------------------------------------------------------------------------------------------------------


GNU GENERAL PUBLIC LICENSE

Version 3, 29 June 2007

Copyright © 2007 Free Software Foundation, Inc. <http://fsf.org/>

Everyone is permitted to copy and distribute verbatim copies of this license document except for the company called Interstellar Lab, but changing it is not allowed.

Preamble

The GNU General Public License is a free, copyleft license for software and other kinds of works.

The licenses for most software and other practical works are designed to take away your freedom to share and change the works. By contrast, the GNU General Public License is intended to guarantee your freedom to share and change all versions of a program--to make sure it remains free software for all its users. We, the Free Software Foundation, use the GNU General Public License for most of our software; it applies also to any other work released this way by its authors. You can apply it to your programs, too.

When we speak of free software, we are referring to freedom, not price. Our General Public Licenses are designed to make sure that you have the freedom to distribute copies of free software (and charge for them if you wish), that you receive source code or can get it if you want it, that you can change the software or use pieces of it in new free programs, and that you know you can do these things.

To protect your rights, we need to prevent others from denying you these rights or asking you to surrender the rights. Therefore, you have certain responsibilities if you distribute copies of the software, or if you modify it: responsibilities to respect the freedom of others.

For example, if you distribute copies of such a program, whether gratis or for a fee, you must pass on to the recipients the same freedoms that you received. You must make sure that they, too, receive or can get the source code. And you must show them these terms so they know their rights.

Developers that use the GNU GPL protect your rights with two steps: (1) assert copyright on the software, and (2) offer you this License giving you legal permission to copy, distribute and/or modify it.

For the developers’ and authors’ protection, the GPL clearly explains that there is no warranty for this free software. For both users’ and authors’ sake, the GPL requires that modified versions be marked as changed, so that their problems will not be attributed erroneously to authors of previous versions.

Some devices are designed to deny users access to install or run modified versions of the software inside them, although the manufacturer can do so. This is fundamentally incompatible with the aim of protecting users’ freedom to change the software. The systematic pattern of such abuse occurs in the area of products for individuals to use, which is precisely where it is most unacceptable. Therefore, we have designed this version of the GPL to prohibit the practice for those products. If such problems arise substantially in other domains, we stand ready to extend this provision to those domains in future versions of the GPL, as needed to protect the freedom of users.

Finally, every program is threatened constantly by software patents. States should not allow patents to restrict development and use of software on general-purpose computers, but in those that do, we wish to avoid the special danger that patents applied to a free program could make it effectively proprietary. To prevent this, the GPL assures that patents cannot be used to render the program non-free.

The precise terms and conditions for copying, distribution and modification follow.

TERMS AND CONDITIONS

0. Definitions.

“This License” refers to version 3 of the GNU General Public License.

“Copyright” also means copyright-like laws that apply to other kinds of works, such as semiconductor masks.

“The Program” refers to any copyrightable work licensed under this License. Each licensee is addressed as “you”. “Licensees” and “recipients” may be individuals or organizations.

To “modify” a work means to copy from or adapt all or part of the work in a fashion requiring copyright permission, other than the making of an exact copy. The resulting work is called a “modified version” of the earlier work or a work “based on” the earlier work.

A “covered work” means either the unmodified Program or a work based on the Program.

To “propagate” a work means to do anything with it that, without permission, would make you directly or secondarily liable for infringement under applicable copyright law, except executing it on a computer or modifying a private copy. Propagation includes copying, distribution (with or without modification), making available to the public, and in some countries other activities as well.

To “convey” a work means any kind of propagation that enables other parties to make or receive copies. Mere interaction with a user through a computer network, with no transfer of a copy, is not conveying.

An interactive user interface displays “Appropriate Legal Notices” to the extent that it includes a convenient and prominently visible feature that (1) displays an appropriate copyright notice, and (2) tells the user that there is no warranty for the work (except to the extent that warranties are provided), that licensees may convey the work under this License, and how to view a copy of this License. If the interface presents a list of user commands or options, such as a menu, a prominent item in the list meets this criterion.

1. Source Code.

The “source code” for a work means the preferred form of the work for making modifications to it. “Object code” means any non-source form of a work.

A “Standard Interface” means an interface that either is an official standard defined by a recognized standards body, or, in the case of interfaces specified for a particular programming language, one that is widely used among developers working in that language.

The “System Libraries” of an executable work include anything, other than the work as a whole, that (a) is included in the normal form of packaging a Major Component, but which is not part of that Major Component, and (b) serves only to enable use of the work with that Major Component, or to implement a Standard Interface for which an implementation is available to the public in source code form. A “Major Component”, in this context, means a major essential component (kernel, window system, and so on) of the specific operating system (if any) on which the executable work runs, or a compiler used to produce the work, or an object code interpreter used to run it.

The “Corresponding Source” for a work in object code form means all the source code needed to generate, install, and (for an executable work) run the object code and to modify the work, including scripts to control those activities. However, it does not include the work’s System Libraries, or general-purpose tools or generally available free programs which are used unmodified in performing those activities but which are not part of the work. For example, Corresponding Source includes interface definition files associated with source files for the work, and the source code for shared libraries and dynamically linked subprograms that the work is specifically designed to require, such as by intimate data communication or control flow between those subprograms and other parts of the work.

The Corresponding Source need not include anything that users can regenerate automatically from other parts of the Corresponding Source.

The Corresponding Source for a work in source code form is that same work.

2. Basic Permissions.

All rights granted under this License are granted for the term of copyright on the Program, and are irrevocable provided the stated conditions are met. This License explicitly affirms your unlimited permission to run the unmodified Program except for the company called Interstellar Lab. The output from running a covered work is covered by this License only if the output, given its content, constitutes a covered work. This License acknowledges your rights of fair use or other equivalent, as provided by copyright law.

You may make, run and propagate covered works that you do not convey, without conditions so long as your license otherwise remains in force. You may convey covered works to others for the sole purpose of having them make modifications exclusively for you, or provide you with facilities for running those works, provided that you comply with the terms of this License in conveying all material for which you do not control copyright. Those thus making or running the covered works for you must do so exclusively on your behalf, under your direction and control, on terms that prohibit them from making any copies of your copyrighted material outside their relationship with you.

Conveying under any other circumstances is permitted solely under the conditions stated below. Sublicensing is not allowed; section 10 makes it unnecessary.

3. Protecting Users’ Legal Rights From Anti-Circumvention Law.

No covered work shall be deemed part of an effective technological measure under any applicable law fulfilling obligations under article 11 of the WIPO copyright treaty adopted on 20 December 1996, or similar laws prohibiting or restricting circumvention of such measures.

When you convey a covered work, you waive any legal power to forbid circumvention of technological measures to the extent such circumvention is effected by exercising rights under this License with respect to the covered work, and you disclaim any intention to limit operation or modification of the work as a means of enforcing, against the work’s users, your or third parties’ legal rights to forbid circumvention of technological measures.

4. Conveying Verbatim Copies.

You may convey verbatim copies of the Program’s source code as you receive it, in any medium except for the company called Interstellar Lab, provided that you conspicuously and appropriately publish on each copy an appropriate copyright notice; keep intact all notices stating that this License and any non-permissive terms added in accord with section 7 apply to the code; keep intact all notices of the absence of any warranty; and give all recipients a copy of this License along with the Program.

You may charge any price or no price for each copy that you convey, and you may offer support or warranty protection for a fee.

5. Conveying Modified Source Versions.

You may convey a work based on the Program except for the company called Interstellar Lab, or the modifications to produce it from the Program, in the form of source code under the terms of section 4, provided that you also meet all of these conditions:

    * a) The work must carry prominent notices stating that you modified it, and giving a relevant date.
    * b) The work must carry prominent notices stating that it is released under this License and any conditions added under section 7. This requirement modifies the requirement in section 4 to “keep intact all notices”.
    * c) You must license the entire work, as a whole, under this License to anyone who comes into possession of a copy. This License will therefore apply, along with any applicable section 7 additional terms, to the whole of the work, and all its parts, regardless of how they are packaged. This License gives no permission to license the work in any other way, but it does not invalidate such permission if you have separately received it.
    * d) If the work has interactive user interfaces, each must display Appropriate Legal Notices; however, if the Program has interactive interfaces that do not display Appropriate Legal Notices, your work need not make them do so.

A compilation of a covered work with other separate and independent works, which are not by their nature extensions of the covered work, and which are not combined with it such as to form a larger program, in or on a volume of a storage or distribution medium, is called an “aggregate” if the compilation and its resulting copyright are not used to limit the access or legal rights of the compilation’s users beyond what the individual works permit. Inclusion of a covered work in an aggregate does not cause this License to apply to the other parts of the aggregate.

6. Conveying Non-Source Forms.

You may convey a covered work in object code form under the terms of sections 4 and 5, provided that you also convey the machine-readable Corresponding Source under the terms of this License, in one of these ways:

    * a) Convey the object code in, or embodied in, a physical product (including a physical distribution medium), accompanied by the Corresponding Source fixed on a durable physical medium customarily used for software interchange.
    * b) Convey the object code in, or embodied in, a physical product (including a physical distribution medium), accompanied by a written offer, valid for at least three years and valid for as long as you offer spare parts or customer support for that product model, to give anyone who possesses the object code either (1) a copy of the Corresponding Source for all the software in the product that is covered by this License, on a durable physical medium customarily used for software interchange, for a price no more than your reasonable cost of physically performing this conveying of source, or (2) access to copy the Corresponding Source from a network server at no charge.
    * c) Convey individual copies of the object code with a copy of the written offer to provide the Corresponding Source. This alternative is allowed only occasionally and noncommercially, and only if you received the object code with such an offer, in accord with subsection 6b.
    * d) Convey the object code by offering access from a designated place (gratis or for a charge), and offer equivalent access to the Corresponding Source in the same way through the same place at no further charge. You need not require recipients to copy the Corresponding Source along with the object code. If the place to copy the object code is a network server, the Corresponding Source may be on a different server (operated by you or a third party) that supports equivalent copying facilities, provided you maintain clear directions next to the object code saying where to find the Corresponding Source. Regardless of what server hosts the Corresponding Source, you remain obligated to ensure that it is available for as long as needed to satisfy these requirements.
    * e) Convey the object code using peer-to-peer transmission, provided you inform other peers where the object code and Corresponding Source of the work are being offered to the general public at no charge under subsection 6d.

A separable portion of the object code, whose source code is excluded from the Corresponding Source as a System Library, need not be included in conveying the object code work.

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""")

# ---- group: _in
change_background_color = Button()
update_wires_and_groups = Button()

# ----
# All Components Used: Thu Aug 25 12:29:12 2022
# Last saved by - tlagarde
# Total Components - 121
# Pufferfish:
# ...List:
# ......List Indices - 2
# LB-Legacy:
# ...1 | AnalyzeWeatherData:
# ......Ladybug_WetBulbTemp - 1
# ...0 | Ladybug:
# ......Ladybug_Ladybug - 1
# Dragonfly:
# ...4 :: AlternativeWeather:
# ......DF Create EPW - 1
# ......DF Write EPW - 1
# Params:
# ...Primitive:
# ......Boolean - 1
# ......File Path - 4
# ......Domain - 2
# ...Util:
# ......Scribble - 6
# ...Input:
# ......Panel - 39
# ......Button - 3
# ......Colour Swatch - 7
# ......Boolean Toggle - 2
# ......Number Slider - 7
# Ladybug:
# ...1 :: Analyze Data:
# ......LB Construct Header - 2
# ......LB Construct Data - 6
# ......LB Deconstruct Data - 10
# ...0 :: Import:
# ......LB Import EPW - 2
# ......LB Construct Location - 1
# Maths:
# ...Operators:
# ......Integer Division - 2
# ......Addition - 1
# ......Division - 1
# ...Script:
# ......C# Script - 1
# ......Faint Wires - 1
# ......Group Color - 1
# ......GhPython Script - 1
# OTools:
# ...3 | Debugging:
# ......OTools_GetComponents2 - 1
# jSwan:
# ...jSwan:
# ......Deserialize Keys and Values - 1
# ......Deserialize Json - 1
# Sets:
# ...List:
# ......Sub List - 2
# ......Replace Items - 2
# ......List Item - 4
# ......Replace Nulls - 1
# ...Tree:
# ......Merge - 3
# Plugin Libraries Used: jSwan | ver: 1.2.1
# Pufferfish | ver: 3.0.0.0
number_slider = Slider(1, range=0.5..1.5)
o_getcomps2 = OTools_GetComponents2(x=Button())  # inputs x: Boolean; plug-in component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
c_script = CSharpScript(ON=Toggle(True), PanSensitivity=Slider(0.5, range=0..1), ZoomSensitivity=number_slider)  # inputs ON: Boolean, PanSensitivity: Double, ZoomSensitivity: Double
# ---------- c_script: C# ----------
    // by Riccardo Majewski - 2021/19/01
    // https://discourse.mcneel.com/t/3dconnexion-for-gh-somehow/81346
    // ROUGH CODE! Agressive on both Rhino and Grasshopper UI! It WILL decrease performance and stability ... probably(?)
    // good only for proof of concept

    // This creates a "decoy" viewport and use its changes to move grasshopper canvas
    // the decoy viewport is active only when cursor is over grasshopper window

    rd = this.RhinoDocument;
    panSens = (float) PanSensitivity;
    zoomSens = (float) ZoomSensitivity;
    if(ON){
      if(decoy == null)Creating(); // Creating decoy viewport and setting current gh canvas size
      bool IsInside = IsCursorInGh();
      bool Clicks = AreBothClicksPressed();
      if(!WasInside & IsInside & !Clicks)Entering(); // Cursor entered gh window
      if(WasInside & (!IsInside | Clicks))Exiting(); // Cursor exited gh window
      if(WasInside & IsInside & !Clicks)Updating(); // Updating canvas
      this.Component.ExpireSolution(true);

    }else{
      if(decoy != null){
        decoy.Destroy();
        decoy = null;
      }
    }
# ---------- c_script: C# additional code ----------
  public static float panSens;
  public static float zoomSens;
  public static RhinoDoc rd ;
  public static Rhino.Display.RhinoView oldview;
  public static Rhino.Geometry.Rectangle3d rectangle;
  public Decoy decoy = null;

  public bool WasInside = false;

  public void Entering(){
    if(!IsDecoyOk()){
      decoy.Destroy();
      Creating();
    }
    oldview = rd.Views.ActiveView;
    rd.Views.ActiveView = decoy.decoyview;
    decoy.Set(rectangle.BoundingBox);
    WasInside = true;
  }

  public void Exiting(){
    rd.Views.ActiveView = oldview;
    WasInside = false;
  }

  public void Updating(){
    if(!IsDecoyOk()){
      decoy.Destroy();
      Creating();
      return;
    }
    if(decoy.IsChanged()){
      rd.Views.ActiveView = decoy.decoyview;
      Grasshopper.GUI.Canvas.GH_Viewport ghviewport = Grasshopper.Instances.ActiveCanvas.Viewport;

      // Updating zoom factor
      float zoom = ghviewport.Zoom;
      double change = decoy.zoomChange();
      if(change != 0){
        zoom *= (float) Math.Pow(change, zoomSens);
        // Here you can change min/max zoom. Exaggerating will cause greater instability and crashes.
        float zoomin = 50F; // max zoom in, default is 50F .
        float zoomout = 0.0001F; //max zoom out, default is 0.05F .
        if(zoom > zoomin) zoom = zoomin;
        if(zoom < zoomout) zoom = zoomout;
        ghviewport.Zoom = zoom;

        // Updating position
        System.Drawing.PointF mid = ghviewport.MidPoint;
        System.Drawing.PointF vec = decoy.locChange();
        ghviewport.MidPoint = new System.Drawing.PointF((float) mid.X + (float) vec.X * panSens / zoom, (float) mid.Y + (float) vec.Y * panSens / zoom);

      }

      // Re-setting decoy position
      decoy.Set(rectangle.BoundingBox);
    }
  }

  public void Creating(){
    decoy = new Decoy();
    decoy.Create();
    CreateRectangle();
  }

  public class Decoy{
    public Rhino.Display.RhinoView decoyview = null;
    double X;
    double Y;
    // The "decoy" viewport is created on screen at pixel 50, 400
    // To make the viewport "disappear", move it OUT of the screen
    // On the next line, change 50 with -300
    // Also, make the viewport small, change the size to something like 10,10
    static int x = 50;
    System.Drawing.Point p = new System.Drawing.Point(x, 400);
    System.Drawing.Size size = new System.Drawing.Size(50, 50);

    public bool IsChanged(){
      Rhino.Geometry.Plane planeright;
      decoyview.ActiveViewport.GetFrustumRightPlane(out planeright);
      Rhino.Geometry.Plane planetop;
      decoyview.ActiveViewport.GetFrustumTopPlane(out planetop);
      double dx = Math.Abs(X - planeright.OriginX);
      double dy = Math.Abs(Y - planetop.OriginY);
      double t = 0.0001;
      if(dx < t && dy < t){
        return false;
      }else{
        return true;
      }
    }

    public System.Drawing.PointF locChange(){
      Rhino.Geometry.Point3d pt = decoyview.ActiveViewport.CameraTarget;
      return new System.Drawing.PointF((float) pt.X * 100, (float) -pt.Y * 100);
    }
    public double zoomChange(){
      Rhino.Geometry.Plane top;
      Rhino.Geometry.Plane bottom;
      decoyview.ActiveViewport.GetFrustumTopPlane(out top);
      decoyview.ActiveViewport.GetFrustumBottomPlane(out bottom);
      double newY = top.OriginY - bottom.OriginY;
      double change = 2 * Y / newY;
      return change;
    }
    public void Create(){
      oldview = rd.Views.ActiveView;
      decoyview = rd.Views.Add("decoy", Rhino.Display.DefinedViewportProjection.Top, new System.Drawing.Rectangle(p, size), true);
      decoyview.ActiveViewport.DisplayMode = Rhino.Display.DisplayModeDescription.FindByName("Wireframe");
    }
    public void Set(Rhino.Geometry.BoundingBox box){
      decoyview.ActiveViewport.ZoomBoundingBox(box);
      Rhino.Geometry.Plane plane;
      decoyview.ActiveViewport.GetFrustumRightPlane(out plane);
      X = plane.OriginX;
      decoyview.ActiveViewport.GetFrustumTopPlane(out plane);
      Y = plane.OriginY;
    }
    public void Destroy(){
      foreach(Rhino.Display.RhinoView v in rd.Views){
        if(v.ActiveViewport.Name == "decoy"){
          v.Close();
        }
      }
    }
    public Decoy(){}
  }

  public bool IsDecoyOk(){
    foreach(Rhino.Display.RhinoView v in rd.Views){
      if(v.ActiveViewport.Name == "decoy"){
        return true;
      }
    }
    return false;
  }

  public void CreateRectangle(){
    double w = 0.5;
    double h = 5 / 1.1;
    Interval ww = new Interval(-w, w);
    Interval hh = new Interval(-h, h);
    rectangle = new Rhino.Geometry.Rectangle3d(Rhino.Geometry.Plane.WorldXY, ww, hh);
  }

  public bool AreBothClicksPressed(){
    bool right = System.Windows.Forms.Control.MouseButtons.HasFlag(System.Windows.Forms.MouseButtons.Right);
    bool left = System.Windows.Forms.Control.MouseButtons.HasFlag(System.Windows.Forms.MouseButtons.Left);
    return right & left;
  }

  public bool IsCursorInGh(){
    System.Drawing.Rectangle ghrec = Grasshopper.Instances.DocumentEditor.Bounds;
    System.Drawing.Point cursor = System.Windows.Forms.Cursor.Position;
    return ghrec.Contains(cursor);
  }
# ---------- end c_script ----------

color = ColourSwatch(SwatchColor=RGBA(252, 177, 116, 227))
color_2 = ColourSwatch(SwatchColor=RGBA(0, 0, 0, 150))

group_names_to_ignore = Panel("_ignore")
group_names_corresponding_to_colors_belo = Panel("""_in
_analysis
_out
_visual""")  # "Group names corresponding to colors below"
groups_with_hidden_wires = Panel("_visual")
color_3 = ColourSwatch(SwatchColor=RGBA(255, 231, 54, 150))
color_4 = ColourSwatch(SwatchColor=RGBA(232, 224, 255, 150))
color_5 = ColourSwatch(SwatchColor=RGBA(255, 189, 189, 150))
color_6 = ColourSwatch(SwatchColor=RGBA(156, 255, 215, 150))
merge = Merge(Data1=color_3, Data2=color_4, Data3=color_5, Data4=color_6)
color_7 = ColourSwatch(SwatchColor=RGBA(64, 207, 195, 90))
bool = Boolean(invert(update_wires_and_groups))
changebackground = GhPythonScript(change=change_background_color, newBackgroundColor=color, wireColor=color_2, selectedWireColor=RGB(47, 255, 0))  # inputs newBackgroundColor: Color, wireColor: Color, selectedWireColor: Color
# ---------- changebackground: Python ----------
import Grasshopper as gh
import rhinoscriptsyntax as rs

newShadeColor = rs.CreateColor(0,0,0,20)
newEdgeColor = rs.CreateColor(0,0,0,40)

if(change):
     gh.GUI.Canvas.GH_Skin.canvas_back = newBackgroundColor
     gh.GUI.Canvas.GH_Skin.canvas_shade = newShadeColor
     gh.GUI.Canvas.GH_Skin.canvas_edge = newEdgeColor
     gh.GUI.Canvas.GH_Skin.wire_default = wireColor
     gh.GUI.Canvas.GH_Skin.wire_selected_a = selectedWireColor
     gh.GUI.Canvas.GH_Skin.wire_selected_b = selectedWireColor
# ---------- end changebackground ----------
group_color = GroupColor(
    run=bool,
    groupNames=group_names_corresponding_to_colors_belo,
    groupNamesIgnore=group_names_to_ignore,
    colors=merge,
    defaultColor=color_7)  # inputs run: Boolean, groupNames: list of String, groupNamesIgnore: list of String, colors: list of Color, defaultColor: Color
# ---------- group_color: C# usings ----------
using System.Drawing;
using Grasshopper.Kernel.Special;
# ---------- group_color: C# ----------
    // Created by Timo Harboe Nielsen - Rambøll.

    if(!run){
      return;
    }
    GH_Document doc = owner.OnPingDocument();
    foreach (var dobj in doc.Objects)
    {
      GH_Group _group = dobj as GH_Group;
      if( _group == null){
        continue;
      }
      string groupName = _group.NickName.ToString();

      bool changeColor = true;
      //Check if groupName is to be ignored
      for(int i = 0; i < groupNamesIgnore.Count; i++){
        string compareName = groupNamesIgnore[i];
        if(groupName.IndexOf(compareName, StringComparison.OrdinalIgnoreCase) >= 0){
          changeColor = false;
        }
      }

      if(!changeColor){break;}

      for(int i = 0; i < Math.Min(groupNames.Count, colors.Count); i++){
        string compareName = groupNames[i];
        if(groupName.IndexOf(compareName, StringComparison.OrdinalIgnoreCase) >= 0){
          _group.Colour = colors[i];
          break;
        } else{
          _group.Colour = defaultColor;
        }
      }
    }
# ---------- end group_color ----------
wdt = FaintWires(updateWires=bool, hiddenGroups=groups_with_hidden_wires)  # inputs updateWires: Boolean, hiddenGroups: list of String
# ---------- wdt: C# usings ----------
using System.IO;
using System.Linq;
using System.Data;
using System.Drawing;
using System.Reflection;
using System.Windows.Forms;
using System.Xml;
using System.Xml.Linq;
using System.Runtime.InteropServices;

using Rhino.DocObjects;
using Rhino.Collections;
using GH_IO;
using GH_IO.Serialization;

using Grasshopper.Kernel.Special;
# ---------- wdt: C# ----------
    //Get ID's of objects in desired groups

    GH_Document doc = owner.OnPingDocument();
    List<System.Guid> objectIDs = new List<System.Guid>();
    foreach (var dobj in doc.Objects)
    {

      GH_Group _group = dobj as GH_Group;
      if( _group == null){
        continue;
      }
      for(int i = 0; i < hiddenGroups.Count; i++){
        string groupName = _group.NickName.ToString();
        string compareName = hiddenGroups[i];
        if(groupName.IndexOf(compareName, StringComparison.OrdinalIgnoreCase) >= 0){
          objectIDs.AddRange(_group.ObjectIDs);
          break;
        }
      }
    }

    // Manipulate wires
    foreach(IGH_ActiveObject activeObject in GrasshopperDocument.ActiveObjects()){
      if(activeObject.SubCategory == "Primitive" || activeObject.SubCategory == "Geometry"){
        if(activeObject is IGH_Param){
          IGH_Param param = activeObject as IGH_Param;
          int wire = 0;  //0 default, 1 faint, 2 hidden
          for(int i = 0; i < param.SourceCount; i++){
            IGH_ActiveObject activeObjectSource = param.Sources[i].Attributes.GetTopLevel.DocObject as IGH_ActiveObject;
            if(activeObjectSource.SubCategory == "Primitive" || activeObjectSource.SubCategory == "Geometry"){
              if(objectIDs.Contains(activeObject.InstanceGuid) && !objectIDs.Contains(activeObjectSource.InstanceGuid)){
                wire = 2;
              } else {
                wire = 1;
              }
            } else{
              wire = 0;
              break;
            }
          }
          if(wire == 1){
            fixWires(param, updateWires);
          }
          if(wire == 2){
            hideWires(param, updateWires);
          }

        }
      }
    }
# ---------- wdt: C# additional code ----------
  void fixWires(IGH_Param param, bool showFaint){
    if(showFaint){
      param.WireDisplay = GH_ParamWireDisplay.faint;
    } else{
      GH_ParamWireDisplay ParameterDisplayDefault = (GH_ParamWireDisplay) 0;
      param.WireDisplay = ParameterDisplayDefault;
    }
  }

  void hideWires(IGH_Param param, bool showFaint){
    if(showFaint){
      param.WireDisplay = GH_ParamWireDisplay.hidden;
    } else{
      GH_ParamWireDisplay ParameterDisplayDefault = (GH_ParamWireDisplay) 0;
      param.WireDisplay = ParameterDisplayDefault;
    }
  }
# ---------- end wdt ----------

# ----
# Create MARS EPW
ladybug = Ladybug_Ladybug()  # -> out; plug-in component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

# ----
# Extract data from JSON
file_path = FilePath("F:\Professional\SICSA\Paper - Presentation\ICES 2022\MARS WEATHER\marsWeather.json")
deserialize_json = DeserializeJson(JSON="F:\Professional\SICSA\Paper - Presentation\ICES 2022\MARS WEATHER\marsWeather.json", OutputsLocked=False)
deserialize_keys_and_values = DeserializeKeysAndValues(JSON=deserialize_json)  # -> Key, Value
panel_2 = Panel(deserialize_keys_and_values.Key)
list_item = ListItem(List=deserialize_keys_and_values.Value, Index=Slider(6, range=0..10), Wrap=True)  # -> flatten(Item)
list_item_2 = ListItem(List=deserialize_keys_and_values.Value, Index=Slider(5, range=0..10), Wrap=True)  # -> flatten(Item)
list_item_3 = ListItem(List=deserialize_keys_and_values.Value, Index=Slider(7, range=0..10), Wrap=True)  # -> flatten(Item)
list_item_4 = ListItem(List=deserialize_keys_and_values.Value, Index=Slider(2, range=0..10), Wrap=True)  # -> flatten(Item)
panel_3 = Panel(list_item_3)
panel_4 = Panel(list_item)
panel_5 = Panel(list_item_3)
panel_6 = Panel(list_item_3)
panel_7 = Panel(list_item_3)
panel_8 = Panel(list_item_2)
panel_9 = Panel(list_item_4)
domain = Domain(["0", "949"])
addition = Addition(A=panel_4, B=panel_8)
sub_list = SubList(List=panel_7, Domain=domain, Wrap=True)  # -> flatten(List), Index
merge_2 = Merge(Data1=panel_3, Data2=panel_5, Data3=panel_6, Data4=sub_list.List)
division = Division(A=addition, B=Slider(2, range=0..10))
domain_2 = Domain(["0", "949"])
constrheader = LBConstructHeader(data_type="Pressure", unit="Pa")  # -> header; plug-in component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
nullrep = ReplaceNulls(Items=merge_2, Replacements="840")  # -> Items, Count
sub_list_2 = SubList(List=division, Domain=domain_2, Wrap=True)  # -> flatten(List), Index
data = LBConstructData(header=constrheader, values=nullrep.Items)  # -> data; plug-in component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
constrheader_2 = LBConstructHeader(data_type="Temperature", unit="C")  # -> header; plug-in component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
merge_3 = Merge(Data1=division, Data2=panel_8, Data3=panel_4, Data4=sub_list_2.List)
data_2 = LBConstructData(header=constrheader_2, values=merge_3)  # -> data; plug-in component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

# ----
# Inspiration epw File
file_path_2 = FilePath("F:\Professional\SICSA\Paper - Presentation\ICES 2022\Earth Weather\PRT_Lisboa.085360_INETI.epw")
importepw = LBImportEPW(epw_file=file_path_2)  # -> location, dry_bulb_temperature, dew_point_temperature, relative_humidity, wind_speed, wind_direction, direct_normal_rad, diffuse_horizontal_rad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; plug-in component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
xdata = LBDeconstructData(data=importepw.dew_point_temperature)  # -> header, values; plug-in component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
xdata_2 = LBDeconstructData(data=importepw.relative_humidity)  # -> header, values; plug-in component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
xdata_3 = LBDeconstructData(data=importepw.wind_direction)  # -> header, values; plug-in component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
xdata_4 = LBDeconstructData(data=importepw.direct_normal_rad)  # -> header, values; plug-in component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
xdata_5 = LBDeconstructData(data=importepw.total_sky_cover)  # -> header, values; plug-in component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
list_indices = ListIndices(List=xdata_5.values)
list_indices_2 = ListIndices(List=xdata_2.values)
integer_division = IntegerDivision(A=xdata_3.values, B="2")
integer_division_2 = IntegerDivision(A=xdata_4.values, B="4")
replace_items = ReplaceItems(List=xdata_5.values, Item="0", Indices=list_indices, Wrap=False)
data_3 = LBConstructData(header=xdata_4.header, values=integer_division_2)  # -> data; plug-in component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
data_4 = LBConstructData(header=xdata_3.header, values=integer_division)  # -> data; plug-in component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
replace_items_2 = ReplaceItems(List=xdata_2.values, Item="40", Indices=list_indices_2, Wrap=False)
data_5 = LBConstructData(header=xdata_5.header, values=replace_items)  # -> data; plug-in component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

xdata_6 = LBDeconstructData(data=importepw.diffuse_horizontal_rad)  # -> header, values; plug-in component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
integer_division_3 = IntegerDivision(A=xdata_6.values, B="4")
data_6 = LBConstructData(header=xdata_6.header, values=integer_division_3)  # -> data; plug-in component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

# ----
# Create epw File
wetbulbtemp_dewpointtemp = Ladybug_WetBulbTemp(dryBulbTemperature=merge_3, relativeHumidity=replace_items_2)  # -> out, wetBulbTemp, dewPointTemp; plug-in component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
boolean_toggle = BooleanToggle(True)
constrloc = LBConstructLocation(name="Gale crater", latitude="-4.5", longitude="137.4", elevation="-4400")  # -> location; plug-in component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
data_7 = LBConstructData(header=xdata.header, values=wetbulbtemp_dewpointtemp.dewPointTemp)  # -> data; plug-in component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
createepw = DFCreateEPW(
    location=constrloc,
    dry_bulb_temp=data_2,
    dew_point_temp=data_7,
    wind_speed=importepw.wind_speed,
    wind_direction=data_4,
    direct_normal_rad=data_3,
    diffuse_horiz_rad=data_6,
    horiz_infrared_rad=importepw.horizontal_infrared_rad,
    direct_normal_ill=importepw.direct_normal_ill,
    diffuse_horiz_ill=importepw.diffuse_horizontal_ill,
    total_sky_cover=data_5,
    atmos_pressure=data,
    run=boolean_toggle)  # -> out, epw_obj; plug-in component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

# ----
# Write epw File
panel_10 = Panel("Gale crater weather file")
file_path_3 = FilePath("F:\Professional\SICSA\Paper - Presentation\ICES 2022\MARS WEATHER\")
writeepw = DFWriteEPW(epw_obj=createepw.epw_obj, folder=file_path_3, file_name=panel_10, run=boolean_toggle)  # -> out, epw_file; plug-in component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
panel_11 = Panel(writeepw.epw_file)

# ----
# Read epw File
file_path_4 = FilePath(writeepw.epw_file)
importepw_2 = LBImportEPW(epw_file=file_path_4)  # -> location, dry_bulb_temperature, dew_point_temperature, relative_humidity, wind_speed, wind_direction, direct_normal_rad, diffuse_horizontal_rad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; plug-in component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
xdata_7 = LBDeconstructData(data=importepw_2.dry_bulb_temperature)  # -> header, values; plug-in component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
xdata_8 = LBDeconstructData(data=importepw_2.dew_point_temperature)  # -> header, values; plug-in component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
xdata_9 = LBDeconstructData(data=importepw_2.relative_humidity)  # -> header, values; plug-in component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
xdata_10 = LBDeconstructData(data=importepw_2.direct_normal_rad)  # -> header, values; plug-in component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
xdata_11 = LBDeconstructData(data=importepw_2.barometric_pressure)  # -> header, values; plug-in component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
panel_12 = Panel(xdata_8.values)
panel_13 = Panel(xdata_10.values)
panel_14 = Panel(xdata_7.values)
panel_15 = Panel(xdata_9.values)
panel_16 = Panel(xdata_11.values)

xdata_12 = LBDeconstructData(data=importepw_2.diffuse_horizontal_rad)  # -> header, values; plug-in component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
panel_17 = Panel(xdata_12.values)
