# Grasshopper definition Mars Base Rhino 2.0.gh (Grasshopper 1.0.7)
# Copyright: All rights reserved
# plug-ins: SpaceSyntaxDesign_GH, jSwan, Parakeet, Antflow, Human, Pufferfish, Heteroptera, MeshEdit Components, CORE.Toolbox.Grasshopper

# ----
# Please reference the original author when using this code
# Monsieur Thomas LAGARDE
# Linkedin https://www.linkedin.com/in/thomas-lagarde
# Projects https://www.researchgate.net/profile/Thomas-Lagarde
# Portfolio https://issuu.com/spacearchitecture
# 
# For any inquiries/bugs/others email me at thomas.lagarde@outlook.com
panel = Panel("""Copyright (C) 2022, SPACE ARCHITECTURE

This program is free software; you can redistribute it and/or modify it except for the company called Interstellar Lab under the terms of the GNU General Public License as published by the Free Software Foundation; either version 3 of the License, or (at your option) any later version.

This program is distributed in the hope that it will be useful, but WITHOUT ANY WARRANTY; without even the implied warranty of MERCHANTABILITY or FITNESS FOR A PARTICULAR PURPOSE. See the GNU General Public License for more details.

You should have received a copy of the GNU General Public License along with this program; if not, see <http://www.gnu.org/licenses>.

Additional permission under GNU GPL version 3 section 7:

This software uses the Rhinoceros RhinoCommon and Grasshopper libraries, which come with/for Rhinoceros 7.0. This softwaredepends fundamentally on the use of Rhinoceros and Grasshopper, and so Rhinocommon, Grasshopper and all associated libraries are assumed to be “System Libraries” as defined by the GPL, and thus are excluded from this license.
Please contact McNeel & Associates for further information.

http://www.en.na.mcneel.com/

This softwareuses Radiance’s gendaymtx.exe, which is subject to its own licensing condition. Radiance software (http://radsite.lbl.gov/) developed by the Lawrence Berkeley National Laboratory  (http://www.lbl.gov/). Please refer to Radiance’s github page for more information:

https://github.com/NREL/Radiance

This softwareuses formulas for PMV and Adatptive comfort models that have been developed by many scientists over several decades and have been published in the ASHRAE55 and EN-15251 international standards.  The code for these formulas has been re-written in Python by Chris Mackey based on the javascript version in the Center for the Built Environment’s Thermal Comfort Tool developed by Hoyt, Tyler; Schiavon, Stefano; Piccioli, Alberto; Moon, Dustin; and Steinfeld, Kyle (2013).  The CBE Comfor Tool is subject to a GPL licence.  For more information, see the Comfort Tool website or the Comfort Tool github:

http://cbe.berkeley.edu/comforttool/ , https://github.com/CenterForTheBuiltEnvironment/comfort_tool

This softwareuses mathematical formulas developed by the UTCI (Universal Thermal Climate Index) project. The UTCI code in This softwarewas re-written in Python by Chris Mackey based on the original F90 UTCI source code of Peter Broede, IfADo - Leibniz Research Centre for Working Environment and Human Factors at Dortmund Technical University, Germany. UTCI is subjected to it’s own license. Please refer to UTCI website for more information:

http://www.utci.org/utci_doku.php

This softwareuses fortran code written by Peter Hoeppe to calculate Physiological Equivalent Temperature. The code is re-written in Python by Djordje Spasic and is used to calculate “Physiological Equivalent Temperature” thermal comfort index in “Thermal comfort indices” component. Please refer to the original code at:

http://www.pland.gov.hk/pland_en/p_study/prog_s/ucmapweb/ucmap_project/content/reports/Comfort_Level_Survey.pdf

This softwareuses Quick Basic code written by Jacques Malchaire to calculate Predicted Heat Strain. The code is re-written in Python by Djordje Spasic and is used to calculate “Predicted Heat Strain” thermal comfort index in “Thermal comfort indices” component. Please refer to the original code at:

http://www.deparisnet.be/chaleur/Normes/Malchaire_PHS_Predicted_Heat_Strain_standard%207933_22-7-13.pdf

This softwareuses Geomag 0.9.2015 source code to calculate True North. Geomag is originally developed by Christopher Weiss, and has been modified by Djordje Spasic. Geomag is subject to the LGPL. For more information refer to the project Page.

https://pypi.python.org/pypi/geomag

This softwareuses Lambert W function code written in python by user: “FB36” from http://code.activestate.com. The code is used to calculate Maximum power voltage and Maximum power current for This softwarePhotovoltaics components. Please refer to the original code at:

http://code.activestate.com/recipes/577729-lambert-w-function

This softwareuses an excerpt of code written in R by Nick Burns to calculate natural wet bulb temperature. The code is re-written in Python by Djordje Spasic and is used to calculate “WBGT indoors” thermal comfort index in “Thermal comfort indices” component. Please refer to the original code at github repository.

https://github.com/nickb-/Calculating-WBGT/blob/master/relaxation_Tw/working_code/wbgt.R

This softwareuses python code written by Clement Greiner to calculate an area of mesh faces. The code is used in “Mars Base Rhino_Mars Base Rhino” component. Please refer to the original code at:

http://discourse.mcneel.com/t/area-of-mesh-face/26609

---------------------------------------------------------------------------------------------------------------------------


GNU GENERAL PUBLIC LICENSE

Version 3, 29 June 2007

Copyright © 2007 Free Software Foundation, Inc. <http://fsf.org/>

Everyone is permitted to copy and distribute verbatim copies of this license document except for the company called Interstellar Lab, but changing it is not allowed.

Preamble

The GNU General Public License is a free, copyleft license for software and other kinds of works.

The licenses for most software and other practical works are designed to take away your freedom to share and change the works. By contrast, the GNU General Public License is intended to guarantee your freedom to share and change all versions of a program--to make sure it remains free software for all its users. We, the Free Software Foundation, use the GNU General Public License for most of our software; it applies also to any other work released this way by its authors. You can apply it to your programs, too.

When we speak of free software, we are referring to freedom, not price. Our General Public Licenses are designed to make sure that you have the freedom to distribute copies of free software (and charge for them if you wish), that you receive source code or can get it if you want it, that you can change the software or use pieces of it in new free programs, and that you know you can do these things.

To protect your rights, we need to prevent others from denying you these rights or asking you to surrender the rights. Therefore, you have certain responsibilities if you distribute copies of the software, or if you modify it: responsibilities to respect the freedom of others.

For example, if you distribute copies of such a program, whether gratis or for a fee, you must pass on to the recipients the same freedoms that you received. You must make sure that they, too, receive or can get the source code. And you must show them these terms so they know their rights.

Developers that use the GNU GPL protect your rights with two steps: (1) assert copyright on the software, and (2) offer you this License giving you legal permission to copy, distribute and/or modify it.

For the developers’ and authors’ protection, the GPL clearly explains that there is no warranty for this free software. For both users’ and authors’ sake, the GPL requires that modified versions be marked as changed, so that their problems will not be attributed erroneously to authors of previous versions.

Some devices are designed to deny users access to install or run modified versions of the software inside them, although the manufacturer can do so. This is fundamentally incompatible with the aim of protecting users’ freedom to change the software. The systematic pattern of such abuse occurs in the area of products for individuals to use, which is precisely where it is most unacceptable. Therefore, we have designed this version of the GPL to prohibit the practice for those products. If such problems arise substantially in other domains, we stand ready to extend this provision to those domains in future versions of the GPL, as needed to protect the freedom of users.

Finally, every program is threatened constantly by software patents. States should not allow patents to restrict development and use of software on general-purpose computers, but in those that do, we wish to avoid the special danger that patents applied to a free program could make it effectively proprietary. To prevent this, the GPL assures that patents cannot be used to render the program non-free.

The precise terms and conditions for copying, distribution and modification follow.

TERMS AND CONDITIONS

0. Definitions.

“This License” refers to version 3 of the GNU General Public License.

“Copyright” also means copyright-like laws that apply to other kinds of works, such as semiconductor masks.

“The Program” refers to any copyrightable work licensed under this License. Each licensee is addressed as “you”. “Licensees” and “recipients” may be individuals or organizations.

To “modify” a work means to copy from or adapt all or part of the work in a fashion requiring copyright permission, other than the making of an exact copy. The resulting work is called a “modified version” of the earlier work or a work “based on” the earlier work.

A “covered work” means either the unmodified Program or a work based on the Program.

To “propagate” a work means to do anything with it that, without permission, would make you directly or secondarily liable for infringement under applicable copyright law, except executing it on a computer or modifying a private copy. Propagation includes copying, distribution (with or without modification), making available to the public, and in some countries other activities as well.

To “convey” a work means any kind of propagation that enables other parties to make or receive copies. Mere interaction with a user through a computer network, with no transfer of a copy, is not conveying.

An interactive user interface displays “Appropriate Legal Notices” to the extent that it includes a convenient and prominently visible feature that (1) displays an appropriate copyright notice, and (2) tells the user that there is no warranty for the work (except to the extent that warranties are provided), that licensees may convey the work under this License, and how to view a copy of this License. If the interface presents a list of user commands or options, such as a menu, a prominent item in the list meets this criterion.

1. Source Code.

The “source code” for a work means the preferred form of the work for making modifications to it. “Object code” means any non-source form of a work.

A “Standard Interface” means an interface that either is an official standard defined by a recognized standards body, or, in the case of interfaces specified for a particular programming language, one that is widely used among developers working in that language.

The “System Libraries” of an executable work include anything, other than the work as a whole, that (a) is included in the normal form of packaging a Major Component, but which is not part of that Major Component, and (b) serves only to enable use of the work with that Major Component, or to implement a Standard Interface for which an implementation is available to the public in source code form. A “Major Component”, in this context, means a major essential component (kernel, window system, and so on) of the specific operating system (if any) on which the executable work runs, or a compiler used to produce the work, or an object code interpreter used to run it.

The “Corresponding Source” for a work in object code form means all the source code needed to generate, install, and (for an executable work) run the object code and to modify the work, including scripts to control those activities. However, it does not include the work’s System Libraries, or general-purpose tools or generally available free programs which are used unmodified in performing those activities but which are not part of the work. For example, Corresponding Source includes interface definition files associated with source files for the work, and the source code for shared libraries and dynamically linked subprograms that the work is specifically designed to require, such as by intimate data communication or control flow between those subprograms and other parts of the work.

The Corresponding Source need not include anything that users can regenerate automatically from other parts of the Corresponding Source.

The Corresponding Source for a work in source code form is that same work.

2. Basic Permissions.

All rights granted under this License are granted for the term of copyright on the Program, and are irrevocable provided the stated conditions are met. This License explicitly affirms your unlimited permission to run the unmodified Program except for the company called Interstellar Lab. The output from running a covered work is covered by this License only if the output, given its content, constitutes a covered work. This License acknowledges your rights of fair use or other equivalent, as provided by copyright law.

You may make, run and propagate covered works that you do not convey, without conditions so long as your license otherwise remains in force. You may convey covered works to others for the sole purpose of having them make modifications exclusively for you, or provide you with facilities for running those works, provided that you comply with the terms of this License in conveying all material for which you do not control copyright. Those thus making or running the covered works for you must do so exclusively on your behalf, under your direction and control, on terms that prohibit them from making any copies of your copyrighted material outside their relationship with you.

Conveying under any other circumstances is permitted solely under the conditions stated below. Sublicensing is not allowed; section 10 makes it unnecessary.

3. Protecting Users’ Legal Rights From Anti-Circumvention Law.

No covered work shall be deemed part of an effective technological measure under any applicable law fulfilling obligations under article 11 of the WIPO copyright treaty adopted on 20 December 1996, or similar laws prohibiting or restricting circumvention of such measures.

When you convey a covered work, you waive any legal power to forbid circumvention of technological measures to the extent such circumvention is effected by exercising rights under this License with respect to the covered work, and you disclaim any intention to limit operation or modification of the work as a means of enforcing, against the work’s users, your or third parties’ legal rights to forbid circumvention of technological measures.

4. Conveying Verbatim Copies.

You may convey verbatim copies of the Program’s source code as you receive it, in any medium except for the company called Interstellar Lab, provided that you conspicuously and appropriately publish on each copy an appropriate copyright notice; keep intact all notices stating that this License and any non-permissive terms added in accord with section 7 apply to the code; keep intact all notices of the absence of any warranty; and give all recipients a copy of this License along with the Program.

You may charge any price or no price for each copy that you convey, and you may offer support or warranty protection for a fee.

5. Conveying Modified Source Versions.

You may convey a work based on the Program except for the company called Interstellar Lab, or the modifications to produce it from the Program, in the form of source code under the terms of section 4, provided that you also meet all of these conditions:

    * a) The work must carry prominent notices stating that you modified it, and giving a relevant date.
    * b) The work must carry prominent notices stating that it is released under this License and any conditions added under section 7. This requirement modifies the requirement in section 4 to “keep intact all notices”.
    * c) You must license the entire work, as a whole, under this License to anyone who comes into possession of a copy. This License will therefore apply, along with any applicable section 7 additional terms, to the whole of the work, and all its parts, regardless of how they are packaged. This License gives no permission to license the work in any other way, but it does not invalidate such permission if you have separately received it.
    * d) If the work has interactive user interfaces, each must display Appropriate Legal Notices; however, if the Program has interactive interfaces that do not display Appropriate Legal Notices, your work need not make them do so.

A compilation of a covered work with other separate and independent works, which are not by their nature extensions of the covered work, and which are not combined with it such as to form a larger program, in or on a volume of a storage or distribution medium, is called an “aggregate” if the compilation and its resulting copyright are not used to limit the access or legal rights of the compilation’s users beyond what the individual works permit. Inclusion of a covered work in an aggregate does not cause this License to apply to the other parts of the aggregate.

6. Conveying Non-Source Forms.

You may convey a covered work in object code form under the terms of sections 4 and 5, provided that you also convey the machine-readable Corresponding Source under the terms of this License, in one of these ways:

    * a) Convey the object code in, or embodied in, a physical product (including a physical distribution medium), accompanied by the Corresponding Source fixed on a durable physical medium customarily used for software interchange.
    * b) Convey the object code in, or embodied in, a physical product (including a physical distribution medium), accompanied by a written offer, valid for at least three years and valid for as long as you offer spare parts or customer support for that product model, to give anyone who possesses the object code either (1) a copy of the Corresponding Source for all the software in the product that is covered by this License, on a durable physical medium customarily used for software interchange, for a price no more than your reasonable cost of physically performing this conveying of source, or (2) access to copy the Corresponding Source from a network server at no charge.
    * c) Convey individual copies of the object code with a copy of the written offer to provide the Corresponding Source. This alternative is allowed only occasionally and noncommercially, and only if you received the object code with such an offer, in accord with subsection 6b.
    * d) Convey the object code by offering access from a designated place (gratis or for a charge), and offer equivalent access to the Corresponding Source in the same way through the same place at no further charge. You need not require recipients to copy the Corresponding Source along with the object code. If the place to copy the object code is a network server, the Corresponding Source may be on a different server (operated by you or a third party) that supports equivalent copying facilities, provided you maintain clear directions next to the object code saying where to find the Corresponding Source. Regardless of what server hosts the Corresponding Source, you remain obligated to ensure that it is available for as long as needed to satisfy these requirements.
    * e) Convey the object code using peer-to-peer transmission, provided you inform other peers where the object code and Corresponding Source of the work are being offered to the general public at no charge under subsection 6d.

A separable portion of the object code, whose source code is excluded from the Corresponding Source as a System Library, need not be included in conveying the object code work.

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""")

# ---- group: _in
change_background_color = Button()
update_wires_and_groups = Button()

# ----
# Plugin Libraries Used: SpaceSyntaxDesign_GH | ver: 1.0.0.1
# jSwan | ver: 1.2.1
# Parakeet | ver: 0.8.3
# Antflow | ver:
# Human | ver: 1.3.1
# Pufferfish | ver: 3.0.0.0
# Heteroptera | ver: 0.7.3.3
# MeshEdit Components | ver: 2.0.0.0
# CORE.Toolbox.Grasshopper | ver:
number_slider = Slider(1, range=0.5..1.5)
update = Button()
c_script = CSharpScript(delete=update)  # inputs delete: Boolean
# ---------- c_script: C# usings ----------
using System.Linq;
# ---------- c_script: C# ----------
    if(delete)
    {
      var doc = this.Component.OnPingDocument();
      if(doc == null)return;
      var objs = doc.Objects;
      var deleteComs = objs.Where(o => o.GetType().ToString() == "Grasshopper.Kernel.Components.GH_PlaceholderComponent").ToList();
      if(deleteComs == null || deleteComs.Count == 0)return;
      doc.ScheduleSolution(20, (d) => doc.RemoveObjects(deleteComs, false));
    }
# ---------- end c_script ----------
o_getcomps2 = OTools_GetComponents2(x=Button())  # inputs x: Boolean; plug-in component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
c_script_2 = CSharpScript(ON=Toggle(True), PanSensitivity=Slider(0.5, range=0..1), ZoomSensitivity=number_slider)  # inputs ON: Boolean, PanSensitivity: Double, ZoomSensitivity: Double
# ---------- c_script_2: C# ----------
    // by Riccardo Majewski - 2021/19/01
    // https://discourse.mcneel.com/t/3dconnexion-for-gh-somehow/81346
    // ROUGH CODE! Agressive on both Rhino and Grasshopper UI! It WILL decrease performance and stability ... probably(?)
    // good only for proof of concept

    // This creates a "decoy" viewport and use its changes to move grasshopper canvas
    // the decoy viewport is active only when cursor is over grasshopper window

    rd = this.RhinoDocument;
    panSens = (float) PanSensitivity;
    zoomSens = (float) ZoomSensitivity;
    if(ON){
      if(decoy == null)Creating(); // Creating decoy viewport and setting current gh canvas size
      bool IsInside = IsCursorInGh();
      bool Clicks = AreBothClicksPressed();
      if(!WasInside & IsInside & !Clicks)Entering(); // Cursor entered gh window
      if(WasInside & (!IsInside | Clicks))Exiting(); // Cursor exited gh window
      if(WasInside & IsInside & !Clicks)Updating(); // Updating canvas
      this.Component.ExpireSolution(true);

    }else{
      if(decoy != null){
        decoy.Destroy();
        decoy = null;
      }
    }
# ---------- c_script_2: C# additional code ----------
  public static float panSens;
  public static float zoomSens;
  public static RhinoDoc rd ;
  public static Rhino.Display.RhinoView oldview;
  public static Rhino.Geometry.Rectangle3d rectangle;
  public Decoy decoy = null;

  public bool WasInside = false;

  public void Entering(){
    if(!IsDecoyOk()){
      decoy.Destroy();
      Creating();
    }
    oldview = rd.Views.ActiveView;
    rd.Views.ActiveView = decoy.decoyview;
    decoy.Set(rectangle.BoundingBox);
    WasInside = true;
  }

  public void Exiting(){
    rd.Views.ActiveView = oldview;
    WasInside = false;
  }

  public void Updating(){
    if(!IsDecoyOk()){
      decoy.Destroy();
      Creating();
      return;
    }
    if(decoy.IsChanged()){
      rd.Views.ActiveView = decoy.decoyview;
      Grasshopper.GUI.Canvas.GH_Viewport ghviewport = Grasshopper.Instances.ActiveCanvas.Viewport;

      // Updating zoom factor
      float zoom = ghviewport.Zoom;
      double change = decoy.zoomChange();
      if(change != 0){
        zoom *= (float) Math.Pow(change, zoomSens);
        // Here you can change min/max zoom. Exaggerating will cause greater instability and crashes.
        float zoomin = 50F; // max zoom in, default is 50F .
        float zoomout = 0.0001F; //max zoom out, default is 0.05F .
        if(zoom > zoomin) zoom = zoomin;
        if(zoom < zoomout) zoom = zoomout;
        ghviewport.Zoom = zoom;

        // Updating position
        System.Drawing.PointF mid = ghviewport.MidPoint;
        System.Drawing.PointF vec = decoy.locChange();
        ghviewport.MidPoint = new System.Drawing.PointF((float) mid.X + (float) vec.X * panSens / zoom, (float) mid.Y + (float) vec.Y * panSens / zoom);

      }

      // Re-setting decoy position
      decoy.Set(rectangle.BoundingBox);
    }
  }

  public void Creating(){
    decoy = new Decoy();
    decoy.Create();
    CreateRectangle();
  }

  public class Decoy{
    public Rhino.Display.RhinoView decoyview = null;
    double X;
    double Y;
    // The "decoy" viewport is created on screen at pixel 50, 400
    // To make the viewport "disappear", move it OUT of the screen
    // On the next line, change 50 with -300
    // Also, make the viewport small, change the size to something like 10,10
    static int x = 50;
    System.Drawing.Point p = new System.Drawing.Point(x, 400);
    System.Drawing.Size size = new System.Drawing.Size(50, 50);

    public bool IsChanged(){
      Rhino.Geometry.Plane planeright;
      decoyview.ActiveViewport.GetFrustumRightPlane(out planeright);
      Rhino.Geometry.Plane planetop;
      decoyview.ActiveViewport.GetFrustumTopPlane(out planetop);
      double dx = Math.Abs(X - planeright.OriginX);
      double dy = Math.Abs(Y - planetop.OriginY);
      double t = 0.0001;
      if(dx < t && dy < t){
        return false;
      }else{
        return true;
      }
    }

    public System.Drawing.PointF locChange(){
      Rhino.Geometry.Point3d pt = decoyview.ActiveViewport.CameraTarget;
      return new System.Drawing.PointF((float) pt.X * 100, (float) -pt.Y * 100);
    }
    public double zoomChange(){
      Rhino.Geometry.Plane top;
      Rhino.Geometry.Plane bottom;
      decoyview.ActiveViewport.GetFrustumTopPlane(out top);
      decoyview.ActiveViewport.GetFrustumBottomPlane(out bottom);
      double newY = top.OriginY - bottom.OriginY;
      double change = 2 * Y / newY;
      return change;
    }
    public void Create(){
      oldview = rd.Views.ActiveView;
      decoyview = rd.Views.Add("decoy", Rhino.Display.DefinedViewportProjection.Top, new System.Drawing.Rectangle(p, size), true);
      decoyview.ActiveViewport.DisplayMode = Rhino.Display.DisplayModeDescription.FindByName("Wireframe");
    }
    public void Set(Rhino.Geometry.BoundingBox box){
      decoyview.ActiveViewport.ZoomBoundingBox(box);
      Rhino.Geometry.Plane plane;
      decoyview.ActiveViewport.GetFrustumRightPlane(out plane);
      X = plane.OriginX;
      decoyview.ActiveViewport.GetFrustumTopPlane(out plane);
      Y = plane.OriginY;
    }
    public void Destroy(){
      foreach(Rhino.Display.RhinoView v in rd.Views){
        if(v.ActiveViewport.Name == "decoy"){
          v.Close();
        }
      }
    }
    public Decoy(){}
  }

  public bool IsDecoyOk(){
    foreach(Rhino.Display.RhinoView v in rd.Views){
      if(v.ActiveViewport.Name == "decoy"){
        return true;
      }
    }
    return false;
  }

  public void CreateRectangle(){
    double w = 0.5;
    double h = 5 / 1.1;
    Interval ww = new Interval(-w, w);
    Interval hh = new Interval(-h, h);
    rectangle = new Rhino.Geometry.Rectangle3d(Rhino.Geometry.Plane.WorldXY, ww, hh);
  }

  public bool AreBothClicksPressed(){
    bool right = System.Windows.Forms.Control.MouseButtons.HasFlag(System.Windows.Forms.MouseButtons.Right);
    bool left = System.Windows.Forms.Control.MouseButtons.HasFlag(System.Windows.Forms.MouseButtons.Left);
    return right & left;
  }

  public bool IsCursorInGh(){
    System.Drawing.Rectangle ghrec = Grasshopper.Instances.DocumentEditor.Bounds;
    System.Drawing.Point cursor = System.Windows.Forms.Cursor.Position;
    return ghrec.Contains(cursor);
  }
# ---------- end c_script_2 ----------
all_components_used = Panel("""Sun Jul 10 10:17:43 2022
Last saved by - tlagarde
Total Components - 475
Heteroptera:
...Geometric:
......Center - 13
Human:
...Misc:
......Item Selector - 5
Surface:
...Util:
......Cap Holes - 4
...Primitive:
......Domain Box - 1
......Cylinder - 1
......Bounding Box - 2
...Freeform:
......Boundary Surfaces - 2
......Extrude - 5
......Pipe - 4
......Patch - 1
...Analysis:
......Volume - 2
......Point In Breps - 1
......Deconstruct Brep - 2
......Brep Edges - 2
......Brep Wireframe - 1
Parakeet:
...Primitive:
......Geodesic Dome - 1
Display:
...Preview:
......Custom Preview - 3
...Dimensions:
......Text Tag - 1
......Text Tag 3D - 1
...Vector:
......Vector Display Ex - 1
OTools:
...3 | Debugging:
......OTools_GetComponents2 - 1
Maths:
...Script:
......Expression - 2
......Tolerance - 1
......GhPython Script - 1
......C# Script - 2
......Group Color - 1
......Faint Wires - 1
...Polynomials:
......Square Root - 2
...Domain:
......Construct Domain - 3
......Bounds - 1
......Remap Numbers - 2
...Trig:
......Degrees - 1
......Radians - 3
...Util:
......Round - 2
......Average - 1
...Operators:
......Mass Addition - 3
......Addition - 8
......Negative - 1
......Subtraction - 1
......Multiplication - 3
......Division - 6
Ladybug:
...2 | VisualizeWeatherData:
......Ladybug_selectSkyMtx - 1
Mesh:
...Util:
......Mesh Brep - 3
...Analysis:
......Mesh Explode - 1
......Face Normals - 1
......Mesh Closest Point - 1
......Mesh Inclusion - 1
TTToolbox:
...Tree:
......Branch by Index - 1
SpaceSyntax:
...Utilities:
......Programme - 1
...GraphDrawing:
......ForceDirectedDrawing - 1
...GRep:
......GraphFromNodes&Links - 1
jSwan:
...jSwan:
......Deserialize Keys and Values - 1
......Deserialize Json - 11
Sets:
...List:
......Sort List - 3
......Split List - 2
......List Length - 2
......Null Item - 1
......Reverse List - 2
......List Item - 14
...Sequence:
......Series - 1
......Cull Pattern - 1
...Tree:
......Merge - 2
......Stream Gate - 1
......Graft Tree - 1
......Explode Tree - 1
...Text:
......Text Split - 3
......Concatenate - 1
...Sets:
......Member Index - 2
......Key/Value Search - 2
......Create Set - 2
Params:
...Geometry:
......Vector - 4
......Mesh - 4
......Curve - 2
......Point - 1
......Brep - 8
......Geometry - 4
...Util:
......Nice Remove Ends - 4
......Scribble - 10
...Primitive:
......B - 1
......File Path - 2
......Boolean - 1
......Data - 1
......Number - 2
...Input:
......Panel - 78
......Button - 4
......Colour Swatch - 8
......Boolean Toggle - 8
......Gradient - 3
......Number Slider - 62
LB-Legacy:
...4 | Renewables:
......Ladybug_Tilt And Orientation Factor - 1
...0 | Ladybug:
......Ladybug_Import epw - 1
......Ladybug_Ladybug - 1
...5 | Extra:
......Ladybug_Legend Parameters - 1
......Ladybug_Gradient Library - 1
......Ladybug_Orientation Study Parameters - 1
...3 | EnvironmentalAnalysis:
......Ladybug_Sunlight Hours Analysis - 2
......Ladybug_Radiation Analysis - 3
...2 | VisualizeWeatherData:
......Ladybug_GenCumulativeSkyMtx - 1
......Ladybug_Wind Rose - 1
......Ladybug_SunPath - 2
...1 | AnalyzeWeatherData:
......Ladybug_Analysis Period - 1
Pufferfish:
...Transform:
......Move To Point - 2
...Mesh:
......Close Mesh - 1
......Reduce Mesh - 1
...Curve:
......Offset Curve - 1
...Surface:
......Extrude Tapered Polysurface - 1
Vector:
...Plane:
......XY Plane - 1
......Deconstruct Plane - 1
......Plane 3Pt - 1
...Grid:
......Square - 1
...Vector:
......Vector 2Pt - 6
......Vector XYZ - 8
......Amplitude - 1
......Unit Z - 1
......Deconstruct Vector - 1
......Angle - 1
...Point:
......Pull Point - 2
......Deconstruct - 1
......Project Point - 2
Curve:
...Primitive:
......Rectangle - 1
......Line - 4
......Circle CNR - 1
......Line SDL - 5
...Util:
......Smooth Polyline - 3
......Explode - 4
...Spline:
......Interpolate - 3
...Analysis:
......Control Points - 4
......Evaluate Curve - 2
......Curve Middle - 2
AntFlow:
...Flow:
......Shortest_Walk - 3
Transform:
...Euclidean:
......Rotate 3D - 1
......Rotate Axis - 2
......Move - 5
...Array:
......Linear Array - 2
......Rectangular Array - 2
...Affine:
......Scale NU - 1
......Scale - 2
......Project - 1
Intersect:
...Mathematical:
......Contour - 1
...Shape:
......Mesh Split - 1
......Solid Difference - 2
......Solid Union - 1
......Mesh Difference - 1
...Physical:
......Multiple Curves - 1""")

color = ColourSwatch(SwatchColor=RGBA(252, 252, 252, 227))
color_2 = ColourSwatch(SwatchColor=RGBA(0, 0, 0, 150))

group_names_to_ignore = Panel("_ignore")
group_names_corresponding_to_colors_belo = Panel("""_in
_analysis
_out
_visual""")  # "Group names corresponding to colors below"
groups_with_hidden_wires = Panel("_visual")
color_3 = ColourSwatch(SwatchColor=RGBA(255, 231, 54, 150))
color_4 = ColourSwatch(SwatchColor=RGBA(232, 224, 255, 150))
color_5 = ColourSwatch(SwatchColor=RGBA(255, 189, 189, 150))
color_6 = ColourSwatch(SwatchColor=RGBA(156, 255, 215, 150))
merge = Merge(Data1=color_3, Data2=color_4, Data3=color_5, Data4=color_6)
color_7 = ColourSwatch(SwatchColor=RGBA(35, 184, 117, 90))
bool = Boolean(invert(update_wires_and_groups))
changebackground = GhPythonScript(change=change_background_color, newBackgroundColor=color, wireColor=color_2, selectedWireColor=RGB(47, 255, 0))  # inputs newBackgroundColor: Color, wireColor: Color, selectedWireColor: Color
# ---------- changebackground: Python ----------
import Grasshopper as gh
import rhinoscriptsyntax as rs

newShadeColor = rs.CreateColor(0,0,0,20)
newEdgeColor = rs.CreateColor(0,0,0,40)

if(change):
     gh.GUI.Canvas.GH_Skin.canvas_back = newBackgroundColor
     gh.GUI.Canvas.GH_Skin.canvas_shade = newShadeColor
     gh.GUI.Canvas.GH_Skin.canvas_edge = newEdgeColor
     gh.GUI.Canvas.GH_Skin.wire_default = wireColor
     gh.GUI.Canvas.GH_Skin.wire_selected_a = selectedWireColor
     gh.GUI.Canvas.GH_Skin.wire_selected_b = selectedWireColor
# ---------- end changebackground ----------
group_color = GroupColor(
    run=bool,
    groupNames=group_names_corresponding_to_colors_belo,
    groupNamesIgnore=group_names_to_ignore,
    colors=merge,
    defaultColor=color_7)  # inputs run: Boolean, groupNames: list of String, groupNamesIgnore: list of String, colors: list of Color, defaultColor: Color
# ---------- group_color: C# usings ----------
using System.Drawing;
using Grasshopper.Kernel.Special;
# ---------- group_color: C# ----------
    // Created by Timo Harboe Nielsen - Rambøll.

    if(!run){
      return;
    }
    GH_Document doc = owner.OnPingDocument();
    foreach (var dobj in doc.Objects)
    {
      GH_Group _group = dobj as GH_Group;
      if( _group == null){
        continue;
      }
      string groupName = _group.NickName.ToString();

      bool changeColor = true;
      //Check if groupName is to be ignored
      for(int i = 0; i < groupNamesIgnore.Count; i++){
        string compareName = groupNamesIgnore[i];
        if(groupName.IndexOf(compareName, StringComparison.OrdinalIgnoreCase) >= 0){
          changeColor = false;
        }
      }

      if(!changeColor){break;}

      for(int i = 0; i < Math.Min(groupNames.Count, colors.Count); i++){
        string compareName = groupNames[i];
        if(groupName.IndexOf(compareName, StringComparison.OrdinalIgnoreCase) >= 0){
          _group.Colour = colors[i];
          break;
        } else{
          _group.Colour = defaultColor;
        }
      }
    }
# ---------- end group_color ----------
wdt = FaintWires(updateWires=bool, hiddenGroups=groups_with_hidden_wires)  # inputs updateWires: Boolean, hiddenGroups: list of String
# ---------- wdt: C# usings ----------
using System.IO;
using System.Linq;
using System.Data;
using System.Drawing;
using System.Reflection;
using System.Windows.Forms;
using System.Xml;
using System.Xml.Linq;
using System.Runtime.InteropServices;

using Rhino.DocObjects;
using Rhino.Collections;
using GH_IO;
using GH_IO.Serialization;

using Grasshopper.Kernel.Special;
# ---------- wdt: C# ----------
    //Get ID's of objects in desired groups

    GH_Document doc = owner.OnPingDocument();
    List<System.Guid> objectIDs = new List<System.Guid>();
    foreach (var dobj in doc.Objects)
    {

      GH_Group _group = dobj as GH_Group;
      if( _group == null){
        continue;
      }
      for(int i = 0; i < hiddenGroups.Count; i++){
        string groupName = _group.NickName.ToString();
        string compareName = hiddenGroups[i];
        if(groupName.IndexOf(compareName, StringComparison.OrdinalIgnoreCase) >= 0){
          objectIDs.AddRange(_group.ObjectIDs);
          break;
        }
      }
    }

    // Manipulate wires
    foreach(IGH_ActiveObject activeObject in GrasshopperDocument.ActiveObjects()){
      if(activeObject.SubCategory == "Primitive" || activeObject.SubCategory == "Geometry"){
        if(activeObject is IGH_Param){
          IGH_Param param = activeObject as IGH_Param;
          int wire = 0;  //0 default, 1 faint, 2 hidden
          for(int i = 0; i < param.SourceCount; i++){
            IGH_ActiveObject activeObjectSource = param.Sources[i].Attributes.GetTopLevel.DocObject as IGH_ActiveObject;
            if(activeObjectSource.SubCategory == "Primitive" || activeObjectSource.SubCategory == "Geometry"){
              if(objectIDs.Contains(activeObject.InstanceGuid) && !objectIDs.Contains(activeObjectSource.InstanceGuid)){
                wire = 2;
              } else {
                wire = 1;
              }
            } else{
              wire = 0;
              break;
            }
          }
          if(wire == 1){
            fixWires(param, updateWires);
          }
          if(wire == 2){
            hideWires(param, updateWires);
          }

        }
      }
    }
# ---------- wdt: C# additional code ----------
  void fixWires(IGH_Param param, bool showFaint){
    if(showFaint){
      param.WireDisplay = GH_ParamWireDisplay.faint;
    } else{
      GH_ParamWireDisplay ParameterDisplayDefault = (GH_ParamWireDisplay) 0;
      param.WireDisplay = ParameterDisplayDefault;
    }
  }

  void hideWires(IGH_Param param, bool showFaint){
    if(showFaint){
      param.WireDisplay = GH_ParamWireDisplay.hidden;
    } else{
      GH_ParamWireDisplay ParameterDisplayDefault = (GH_ParamWireDisplay) 0;
      param.WireDisplay = ParameterDisplayDefault;
    }
  }
# ---------- end wdt ----------

file_path = FilePath("F:\Professional\SICSA\Paper - Presentation\IAC 2021\SIMOC\SIMOC Results Preset 4.json")
panel_2 = Panel("Read JSON file")
deserialize_json = DeserializeJson(JSON=file_path, OutputsLocked=False)  # -> README, Steps, Parameters, Total_consumption, Total_production, Total_agent_count, Agent_growth, Storage_ratios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
deserialize_json_2 = DeserializeJson(JSON=deserialize_json.Configuration, OutputsLocked=False)  # -> Location, Duration, Humans, Food, Eclss, PowerGeneration, PowerStorage, CrewQuarters, Greenhouse, PlantSpecies
deserialize_keys_and_values = DeserializeKeysAndValues(JSON=deserialize_json.Details_per_agent, Keys=Slider(69, range=1..351))  # -> Key, Value
panel_3 = Panel(deserialize_keys_and_values.Value)
deserialize_json_3 = DeserializeJson(JSON=deserialize_keys_and_values.Value, OutputsLocked=False)
deserialize_json_4 = DeserializeJson(JSON=deserialize_json_2.PowerStorage, OutputsLocked=False)  # -> Type, Amount, Units
deserialize_json_5 = DeserializeJson(JSON=deserialize_json_2.PowerGeneration, OutputsLocked=False)  # -> Type, Amount, Units
deserialize_json_6 = DeserializeJson(JSON=deserialize_json_2.Greenhouse, OutputsLocked=False)  # -> Type, Amount, Units
deserialize_json_7 = DeserializeJson(JSON=deserialize_json_2.CrewQuarters, OutputsLocked=False)  # -> Type, Amount, Units
deserialize_json_8 = DeserializeJson(JSON=deserialize_json_2.PlantSpecies, OutputsLocked=False)  # -> Type, Amount
panel_4 = Panel(deserialize_json_3)
deserialize_json_9 = DeserializeJson(JSON=deserialize_json_3, OutputsLocked=False)  # -> Enrg_kwh, Atmo_co2
panel_5 = Panel(deserialize_json_9.Enrg_kwh)
panel_6 = Panel(deserialize_json_5.Type)
panel_7 = Panel(deserialize_json_5.Amount)
panel_8 = Panel(deserialize_json_4.Type)
panel_9 = Panel(deserialize_json_4.Amount)
panel_10 = Panel("1000 kWh battery")
panel_11 = Panel(deserialize_json_7.Type)
panel_12 = Panel(deserialize_json_8.Type)
panel_13 = Panel(deserialize_json_8.Amount)
panel_14 = Panel(deserialize_json_6.Type)
deserialize_json_10 = DeserializeJson(JSON=deserialize_json_9.Enrg_kwh, OutputsLocked=False)  # -> Solid_waste_aerobic_bioreactor, Multifiltration_purifier_post_treatment, Oxygen_generation_SFWE, Urine_recycling_processor_VCD, Co2_removal_SAWD, Co2_reduction_sabatier, Ch4_removal_agent, Dehumidifier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
deserialize_json_11 = DeserializeJson(JSON=deserialize_json_10.Oxygen_generation_SFWE, OutputsLocked=False)  # -> Value, Unit
panel_15 = Panel(deserialize_json_11.Value)

cumulative_radiation_over_a_given_period = BooleanToggle(True)  # "Cumulative radiation over a given period in kWh/m2"
panel_16 = Panel("WEATHER DATA")
wind_rose = BooleanToggle(False)
orient_greenhouse = BooleanToggle(True)
orient_solar_array = BooleanToggle(True)
ladybug = Ladybug_Ladybug()  # -> out; plug-in component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
epw_file = FilePath("F:\Professional\SICSA\Paper - Presentation\IAC 2021\MARS WEATHER\Gale crater weather file.epw")

brep_terrain = Brep(<brep referenced from the Rhino model>)
panel_17 = Panel("Rhino connexion")
mesh_brep = MeshBrep(
    Brep=brep_terrain,
    Settings={GridMaxCount=0, GridMinCount=16, JaggedSeams=False, MaxEdgeLength=0, MinEdgeLength=0.0001, MinTolerance=0, Refine=True, RefineAngle=0, RelativeTolerance=0.65, SimplePlanes=True, Tolerance=0})
mesh_terrain = Mesh(mesh_brep)
obstacle = Brep(<brep referenced from the Rhino model>)
greenhouse = Brep(<brep referenced from the Rhino model>)
habitat = Brep(<brep referenced from the Rhino model>)
battery = Brep(<brep referenced from the Rhino model>)
pv = Brep(<brep referenced from the Rhino model>)
center = Center(Geometry=greenhouse)  # -> Center, Dimension
center_2 = Center(Geometry=habitat)  # -> Center, Dimension
center_3 = Center(Geometry=battery)  # -> Center, Dimension
center_4 = Center(Geometry=pv)  # -> Center, Dimension
reduce_mesh = ReduceMesh(
    Mesh=mesh_terrain,
    FaceCount=Slider(30000, range=0..100000),
    Accuracy=Slider(2, range=0..10),
    FaceType=0,
    Distort=True,
    Normalize=False)  # -> Reduced, CountDifference
disable_ground_analysis = Mesh(reduce_mesh.Reduced)

panel_18 = Panel(deserialize_json_2.Duration)
mass_addition = MassAddition(Input=panel_13)  # -> Result, PartialResults
panel_19 = Panel(mass_addition.Result)

panel_20 = Panel("Build battery storage")
vector = Vector(Vector(-32.18003507, 0, 0))
vector_2 = Vector(Vector(0, 8.784883445, 0))
line_sdl = LineSDL(Start=center_3.Center, Direction=vector, Length="0.7")
line_sdl_2 = LineSDL(Start=center_3.Center, Direction=vector_2, Length="0.8")
control_points = ControlPoints(Curve=line_sdl_2)  # -> Points, Weights, Knots
control_points_2 = ControlPoints(Curve=line_sdl)  # -> Points, Weights, Knots
remove_ends = NiceRemoveEnds(L=control_points.Points)  # -> A, B, B_2
remove_ends_2 = NiceRemoveEnds(L=control_points_2.Points)  # -> A, B, B_2
vector_2pt = Vector2Pt(PointA=remove_ends.A, PointB=remove_ends.B_2, Unitize=False)  # -> Vector, Length
vector_2pt_2 = Vector2Pt(PointA=remove_ends_2.A, PointB=remove_ends_2.B_2, Unitize=False)  # -> Vector, Length
move = Move(Geometry=line_sdl, Motion=vector_2pt.Vector)  # -> Geometry, Transform
move_2 = Move(Geometry=line_sdl_2, Motion=vector_2pt_2.Vector)  # -> Geometry, Transform
boundary_surfaces = BoundarySurfaces(Edges=[line_sdl_2, line_sdl, move_2.Geometry, move.Geometry])
number_slider_2 = Slider(0, range=0..10)
vector_xyz = VectorXYZ(XComponent=number_slider_2, YComponent=number_slider_2, ZComponent=Slider(0.7, range=0..10))  # -> Vector, Length
extrude = Extrude(Base=boundary_surfaces, Direction=vector_xyz.Vector)
square_root = SquareRoot(Value=panel_9)
division = Division(A=square_root, B=Slider(2, range=0..10))
number_slider_3 = Slider(1.1, range=-100..100)
round = Round(Number=division)  # -> Nearest, Floor, Ceiling
scale_nu = ScaleNU(
    Geometry=boundary_surfaces,
    Plane=PlaneXY(0, 0, 0),
    ScaleX=number_slider_3,
    ScaleY=number_slider_3,
    ScaleZ=number_slider_3)  # -> Geometry, Transform
addition = Addition(A=round.Nearest, B=Slider(1, range=0..10))
addition_2 = Addition(A=round.Nearest, B=Slider(-1, range=-10..10))
rectangular_array = RectangularArray(Geometry=extrude, Cell=scale_nu.Geometry, XCount=addition, YCount=addition_2)  # -> Geometry, Transform
geometry = Geometry(rectangular_array.Geometry)
center_5 = Center(Geometry=geometry)  # -> Center, Dimension
project_point = ProjectPoint(Point=center_5.Center, Direction=Vector(0, 0, -1), Geometry=reduce_mesh.Reduced)  # -> Point, Index
move_to_point = MoveToPoint(Geometry=geometry, PointA=center_5.Center, PointB=project_point.Point)  # -> Moved, Vector, Transform
number_slider_4 = Slider(0, range=0..10)
item = ListItem(List=move_to_point.Moved, Index=Slider(0, range=-10..10), Wrap=True)
vector_xyz_2 = VectorXYZ(XComponent=number_slider_4, YComponent=number_slider_4, ZComponent=Slider(0.8, range=0..10))  # -> Vector, Length
linear_array = LinearArray(Geometry=move_to_point.Moved, Direction=vector_xyz_2.Vector, Count=Slider(4, range=0..10))  # -> Geometry, Transform

# ---- group: AdvancedSettings
st = Slider(0.2334, range=0..2)
st_2 = Slider(2.7792, range=0..10)
it = Slider(108, range=0..4000)
tolerance = Tolerance(0.01)

# ----
# Build domes or extrusion
# Change if the orienation is wrong
graphfromnodes_links = GraphFromNodesLinks()  # -> Graph, GraphVertices, Attributes
forcedirecteddrawing = ForceDirectedDrawing(
    Graph=graphfromnodes_links.Graph,
    Vertices=graphfromnodes_links.GraphVertices,
    Attributes=graphfromnodes_links.Attributes,
    AttractionStrength=st,
    RepulsionStrength=st_2,
    ConvergenceTolearnce=tolerance,
    MaximumIterations=it,
    Active=Toggle(True))  # -> NewGraphVertices, IterationCount
number_slider_5 = Slider(0, range=0..1)
text_tag = TextTag(Location=forcedirecteddrawing.NewGraphVertices)
prgm = Programme(Attributes=graphfromnodes_links.Attributes)  # -> Tags, Areas, Colors, Legends
expression = Expression(x=prgm.Areas, Expression="Sqrt(x/π)")
scale = Slider(1, range=0..10)
vector_xyz_3 = VectorXYZ(XComponent=number_slider_5, YComponent=number_slider_5, ZComponent=Slider(4, range=0..10))  # -> Vector, Length
multiplication = Multiplication(A=expression, B=scale)
circle_cnr = CircleCNR(Center=forcedirecteddrawing.NewGraphVertices, Normal=Vector(0, 0, 1), Radius=multiplication)
geodesic_dome = GeodesicDome(BasePoint=forcedirecteddrawing.NewGraphVertices, Radius=multiplication, DomeFrequency=3)  # -> GeodeicDome, BaseMesh, GeodesicPoints, GeodesicEdges
extrude_tapered_polysurface = ExtrudeTaperedPolysurface(
    Profile=circle_cnr,
    Direction=vector_xyz_3.Vector,
    Angle=Slider(5, range=0..100),
    CornerType=Slider(3, range=0..100),
    FaceMerge=True)
cap_holes = CapHoles(Brep=extrude_tapered_polysurface)
mesh_split = MeshSplit(Mesh=geodesic_dome.GeodeicDome)
number_slider_6 = Slider(1, range=0..1)
explode_tree = ExplodeTree(Data=mesh_split)  # -> Branch0, Branch1
split_list = SplitList(List=explode_tree.Branch0, Index=number_slider_6)  # -> ListA, ListB
split_list_2 = SplitList(List=explode_tree.Branch1, Index=number_slider_6)  # -> ListA, ListB
mesh = Mesh(split_list.ListB)

panel_21 = Panel("Build rectangle Greenhouse")
split = TextSplit(Text=deserialize_json_6.Type, Separators="_")
item_selector = ItemSelector(split, {"greenhouse", "small"}, selected="small")
panel_22 = Panel("""small
medium
large""")
panel_23 = Panel("""7,15
15,35
20,60""")
keysearch = KeyValueSearch(Keys=panel_22, Values=panel_23, Search=item_selector)
split_2 = TextSplit(Text=keysearch, Separators=",")
number_slider_7 = Slider(0, range=0..10)
pull_point = PullPoint(Point=center.Center, Geometry=reduce_mesh.Reduced, ClosestOnly=True)  # -> ClosestPoint, Distance
item_2 = ListItem(List=split_2, Index=0, Wrap=True)  # -> Item, Item1
vector_xyz_4 = VectorXYZ(XComponent=number_slider_7, YComponent=number_slider_7, ZComponent=Slider(5.5, range=0..10))  # -> Vector, Length
rectangle = Rectangle(Plane=pull_point.ClosestPoint, XSize=item_2.Item, YSize=item_2.Item1, Radius=Slider(1, range=0..10))  # -> Rectangle, Length
extrude_2 = Extrude(Base=rectangle.Rectangle, Direction=vector_xyz_4.Vector)
cap_holes_2 = CapHoles(Brep=extrude_2)

panel_24 = Panel("Build Circular Habitat")
split_3 = TextSplit(Text=deserialize_json_7.Type, Separators="_")
item_selector_2 = ItemSelector(split_3, {"crew", "habitat", "medium"}, selected="medium")
pull_point_2 = PullPoint(Point=center_2.Center, Geometry=reduce_mesh.Reduced, ClosestOnly=True)  # -> flatten(ClosestPoint), Distance
panel_25 = Panel("""small
medium
large""")
panel_26 = Panel("""10
15
20""")
keysearch_2 = KeyValueSearch(Keys=panel_25, Values=panel_26, Search=item_selector_2)
cylinder = Cylinder(Base=pull_point_2.ClosestPoint, Radius=keysearch_2, Length="4")
cap_holes_3 = CapHoles(Brep=cylinder)

analysisperiod = Ladybug_AnalysisPeriod(
    fromMonth=Slider(4, range=0..10),
    fromDay=Slider(4, range=0..10),
    fromHour=Slider(4, range=0..10),
    toMonth=Slider(5, range=0..10),
    toDay=Slider(5, range=0..10),
    toHour=Slider(7, range=0..10))  # -> out, analysisPeriod; plug-in component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
center_6 = Center(Geometry=cap_holes_3)  # -> Center, Dimension
center_7 = Center(Geometry=cap_holes_2)  # -> Center, Dimension

# ----
# Orient building optimally to the sun
# Highest
# Lowest
# Highest
# Lowest
number_slider_8 = Slider(0, range=0..10)
importepw = Ladybug_ImportEpw(epwFile=epw_file)  # -> Output, latitude, location, dryBulbTemperature, dewPointTemperature, relativeHumidity, windSpeed, windDirection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; plug-in component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
gencumulativeskymtx = Ladybug_GenCumulativeSkyMtx(epwFile=epw_file, skyDensity=number_slider_8, useOldRes=True, runIt=Toggle(True))  # -> out, cumulativeSkyMtx; plug-in component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
sunpath = Ladybug_SunPath(location=importepw.location, hour=12, day=21, month=12, timeStep=1, dailyOrAnnualSunPath=True)  # -> out, sunVectors, sunAltitudes, sunAzimuths, port, sunSpheresMesh, sunPathCrvs, compassCrvs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; plug-in component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
selectskymtx = Ladybug_selectSkyMtx(cumulativeSkyMtx=gencumulativeskymtx.cumulativeSkyMtx, removeDiffuse=False, removeDirect=False)  # -> readMe, selectedSkyMtx; plug-in component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
orientationstudypar = Ladybug_OrientationStudyParameters(divisionAngle="45", totalAngle="360", runTheStudy=orient_greenhouse)  # -> orientationStudyPar; plug-in component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
number_slider_9 = Slider(1, range=0..1)
slider = Slider(4, range=0..10)
radiationanalysis = Ladybug_RadiationAnalysis(
    geometry=flatten(cap_holes_2),
    context=flatten(obstacle),
    gridSize=slider,
    disFromBase=number_slider_9,
    orientationStudyP=flatten(orientationstudypar),
    selectedSkyMtx=flatten(selectskymtx.selectedSkyMtx),
    parallel=orient_greenhouse,
    runIt=orient_greenhouse)  # -> out, contextMesh, analysisMesh, testPts, testVec, port, radiationResult, radiationMesh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; plug-in component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
sunlighthoursanalysis = Ladybug_SunlightHoursAnalysis(
    geometry=flatten(cap_holes_2),
    context=flatten(obstacle),
    gridSize=slider,
    disFromBase=number_slider_9,
    orientationStudyP=flatten(orientationstudypar),
    sunVectors=flatten(sunpath.sunVectors),
    timeStep=1,
    parallel=orient_greenhouse,
    runIt=orient_greenhouse)  # -> out, contextMesh, analysisMesh, testPts, testVec, port, sunlightHoursResult, sunlightHoursMesh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; plug-in component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
sort = SortList(Keys=radiationanalysis.totalRadiation)  # -> Keys, ValuesA
sort_2 = SortList(Keys=sunlighthoursanalysis.totalSunlightHours)  # -> Keys, ValuesA
rev = ReverseList(List=sort.Keys)
cset = CreateSet(List=sunlighthoursanalysis.totalSunlightHours)  # -> Set, Map
item_3 = ListItem(List=sort_2.Keys, Index="0", Wrap=True)
rev_2 = ReverseList(List=sort_2.Keys)
cset_2 = CreateSet(List=radiationanalysis.totalRadiation)  # -> Set, Map
item_4 = ListItem(List=sort.Keys, Index="0", Wrap=True)
item_5 = ListItem(List=rev, Index="0", Wrap=True)
item_6 = ListItem(List=rev_2, Index="0", Wrap=True)
mindex = MemberIndex(Set=cset.Set, Member=[item_6, item_3])  # -> Index, Count
mindex_2 = MemberIndex(Set=cset_2.Set, Member=[item_5, item_4])  # -> Index, Count
orientation_angles = Panel(mindex.Index)
orientation_angles_2 = Panel(mindex_2.Index)
item_selector_3 = ItemSelector(orientation_angles, {"2", "0"}, selected="2")
item_selector_4 = ItemSelector(orientation_angles_2, {"0", "2"}, selected="0")
multiplication_2 = Multiplication(A=item_selector_3, B="45")
multiplication_3 = Multiplication(A=item_selector_4, B="45")
addition_3 = Addition(A=multiplication_2, B=multiplication_3)
division_2 = Division(A=addition_3, B=Slider(2, range=0..10))
radians = Radians(Degrees=division_2)
rotate_3d = Rotate3D(Geometry=cap_holes_2, Angle=radians, Center=center_7.Center, Axis=Vector(0, 0, 1))  # -> Geometry, Transform

center_8 = Center(Geometry=rotate_3d.Geometry)  # -> Center, Dimension

panel_27 = Panel("Wind rose")
windrose = Ladybug_WindRose(
    north=0,
    hourlyWindDirection=importepw.windDirection,
    hourlyWindSpeed=importepw.windSpeed,
    centerPoint=center_7.Center,
    scale=Slider(0.5, range=-10..10),
    runIt=wind_rose)  # -> out, calmRoseMesh, windRoseMesh, windRoseCrvs, windRoseCenPts, legend, legendBasePts, title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; plug-in component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

# ---- group: set pixel size (small=slow)
pixel_size = Slider(1, range=0..10)

# ----
pixel_size_2 = Slider(1.25, range=0..10)
pick_travel_paths = Curve([<curve referenced from the Rhino model> x3])
panel_28 = Panel("Build plant trays")
offset_curve = OffsetCurve(Curve=pick_travel_paths, Plane=PlaneXY(0, 0, 0), Distance=pixel_size_2, BothSides=0, Kinks=0, CapType=1)
explode = Explode(Curve=offset_curve, Recursive=True)  # -> Segments, Vertices
curve = Curve(explode.Segments)
multiple_curves = MultipleCurves(Curves=flatten(curve))  # -> Points, IndexA, IndexB, ParamA, ParamB
patch = Patch(Curves=curve, Points=multiple_curves.Points, Spans=20, Flexibility=1, Trim=True)
pixel_size_3 = Slider(8.82, range=0..10)
vector_xyz_5 = VectorXYZ(XComponent=0, YComponent=0, ZComponent=pixel_size_3)  # -> Vector, Length
extrude_3 = Extrude(Base=patch, Direction=vector_xyz_5.Vector)
solid_union = SolidUnion(Breps=flatten(extrude_3))
solid_difference = SolidDifference(BrepsA=cap_holes_2, BrepsB=solid_union)
geo = Geometry(solid_difference)
bbox = BoundingBox(Content=geo, Plane=PlaneXY(0, 0, 0))  # -> Box, Box_2
debrep = DeconstructBrep(Brep=bbox.Box)  # -> Faces, Edges, Vertices
item_7 = ListItem(List=debrep.Vertices, Index=0, Wrap=True)  # -> Item2, Item1, Item
vec2pt = Vector2Pt(PointA=item_7.Item, PointB=item_7.Item2, Unitize=False)  # -> Vector, Length
pixel_size_4 = Number(pixel_size)
devec = DeconstructVector(Vector=vec2pt.Vector)  # -> XComponent, YComponent, ZComponent
division_3 = Division(A=devec.XComponent, B=pixel_size_4)
division_4 = Division(A=devec.YComponent, B=pixel_size_4)
division_5 = Division(A=devec.ZComponent, B=pixel_size_4)
geo_2 = Geometry(geo)
sqgrid = Square(Plane=item_7.Item, Size=pixel_size_4, ExtentX=expr("x+1", division_3), ExtentY=expr("x+1", division_4))  # -> Cells, Points
Z = UnitZ(Factor=pixel_size_4)
brep = Brep(geo_2)
null = NullItem(Item=brep)  # -> NullFlags, InvalidFlags, Description
arrlinear = LinearArray(Geometry=sqgrid.Points, Direction=Z, Count=expr("x+1", division_5))  # -> flatten(Geometry), Transform
gate = StreamGate(Stream=geo_2, Gate=null.NullFlags)  # -> Target0, Target1
pt = Point(arrlinear.Geometry)
mesh_2 = Mesh(gate.Target1)
minc = MeshInclusion(Mesh=mesh_2, Point=pt, Strict=True)
brepsinc = PointInBreps(Brep=gate.Target0, Point=pt, Strict=True)  # -> Inside, Index
pixel_size_5 = Number(pixel_size)
_2 = B(2)
merge_2 = Merge(Data1=minc, Data2=brepsinc.Inside)
division_6 = Division(A=pixel_size_5, B=_2)
cull = CullPattern(List=pt, CullPattern=merge_2)
dom = ConstructDomain(DomainStart=expr("-x", division_6), DomainEnd=division_6)
box = DomainBox(Base=cull, X=dom, Y=dom, Z=dom)
rotate_3d_2 = Rotate3D(Geometry=box, Angle=radians, Center=center_7.Center, Axis=Vector(0, 0, 1))  # -> Geometry, Transform
list_length = ListLength(List=box)
panel_29 = Panel(list_length)
preview = CustomPreview(Geometry=rotate_3d_2.Geometry, Shader=ColourSwatch(SwatchColor=RGB(186, 53, 0)))

# ---- group: bounded to the number of triangulations
triangulation = Slider(6, range=0..30)

# ----
panel_30 = Panel("Floor plan analysis")
file_path_2 = FilePath("F:\Professional\SICSA\Paper - Presentation\ICES 2022\Minimum volume.xlsx")
read_from_excel = ReadFromExcel(WorkbookFilepath=file_path_2, WorksheetName="Gravity", Live=False, Stream=Toggle(True))
ta = Slider(1, range=0..20)
split_list_3 = SplitList(List=read_from_excel, Index=ta)  # -> ListA, ListB
panel_31 = Panel(split_list_3.ListA)
panel_32 = Panel(split_list_3.ListB)
simplify_tree = SimplifyTree(Tree=panel_32, Front=False)  # -> flatten(Tree)
P = Points([<points referenced from the Rhino model> x10])
crv = Curve([<curve referenced from the Rhino model> x41])
xy = XYPlane(Origin=Point(-35.92729571, 204.6599472, 0))
mass_addition_2 = MassAddition(Input=simplify_tree)  # -> Result, PartialResults
news_graph = GraphFromNodesLinksWithNEWS(Points=P, Links=flatten(crv), Labels=flatten(panel_31), Areas=flatten(panel_32), TotalArea=mass_addition_2.Result)  # -> Graph, GraphVertices, Attributes
bp = BasePlane(xy)
tuttedrawing = TutteConvexDrawing(BasePlane=bp, Graph=news_graph.Graph, Vertices=news_graph.GraphVertices, Attributes=news_graph.Attributes)  # -> NewGraphVertices, ConvexFaceBorders, SubGraph, SubVertices, SubAttributes
exct = BooleanToggle(False)
triangulate = TriangulateMeshInAllWays(
    TutteOutputVerticesIncludingNEWS=flatten(tuttedrawing.NewGraphVertices),
    ConvexFaceBorders=flatten(tuttedrawing.ConvexFaceBorders),
    IndexOfTriangulation=flatten(triangulation),
    ExcludeDegenerateTINS=exct)  # -> AllTriangularMeshes, TheChosenTriangularMesh
dualgraph = DualGraph(NEWS_Triangulated_Mesh=triangulate.TheChosenTriangularMesh, SubAttributes=tuttedrawing.SubAttributes)  # -> DualVertices, DualFaces, DualFaceBorders, DualFaceColors
number_slider_10 = Slider(14, range=3..15)
number_slider_11 = Slider(15.024, range=0..100)
scale_2 = Slider(0.27, range=0..50)
scale_3 = Slider(0.27, range=0..50)
scale_4 = Slider(48.6, range=0..50)
cgraph = CellGraph(Cells=flatten(dualgraph.DualFaceBorders))  # -> Graph, GraphVertices
expression_2 = Expression(n=number_slider_10, r=number_slider_11, Expression="r/Cos((2*π/n)/2)")
forcedirecteddrawing_2 = ForceDirectedDrawing(
    Graph=cgraph.Graph,
    Vertices=tuttedrawing.SubVertices,
    Attributes=tuttedrawing.SubAttributes,
    AttractionStrength=scale_3,
    RepulsionStrength=scale_2,
    ConvergenceTolearnce=0.001,
    MaximumIterations=scale_4,
    Active=Toggle(True))  # -> NewGraphVertices, IterationCount
scale_5 = Slider(1.5, range=0..10)
pt_2 = Point(pull_point_2.ClosestPoint)
panel_33 = Panel(forcedirecteddrawing_2.IterationCount)
construct_plane = ConstructPlane(Origin=pt_2, XAxis=Vector(1, 0, 0), YAxis=Vector(0, 1, 0))
polygon = Polygon(Plane=pt_2, Radius=expression_2, Segments=number_slider_10, FilletRadius=0)  # -> Polygon, Length
cir = Circle(Plane=pt_2, Radius=number_slider_11)
att_tor = Att_toR(B=scale_5, att=tuttedrawing.SubAttributes)  # -> R, M
relocate = RelocateVertices(BasePLane=construct_plane, Vertices=forcedirecteddrawing_2.NewGraphVertices)
diskograph = DiskoGraphDrawing(
    Plane=construct_plane,
    Graph=tuttedrawing.SubGraph,
    Vertices=forcedirecteddrawing_2.NewGraphVertices,
    Attributes=tuttedrawing.SubAttributes,
    Thickness=3)
weightedvoronoi = WeightedVoronoi(BasePlane=construct_plane, Points=relocate, Radii=att_tor.R, BoundingCurve=polygon.Polygon)  # -> AdjacencyGraph, VoronoiCells
srf = Surface(weightedvoronoi.VoronoiCells)
preview_2 = CustomPreview(Geometry=srf, Shader=att_tor.M)

# ----
# Shadow Analysis pick the right time
days = Slider(8, range=0..30)
months = Slider(7, range=0..12)
series = Series(Start="6", Step=1, Count="22")
sunpath_2 = Ladybug_SunPath(location=importepw.location, hour=series, day=days, month=months, timeStep=1, dailyOrAnnualSunPath=True)  # -> readMe, sunVectors, sunAltitudes, sunAzimuths, port, sunSpheresMesh, sunPathCrvs, compassCrvs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; plug-in component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
lng = ListLength(List=sunpath_2.sunVectors)
gradientlibrary = Ladybug_GradientLibrary(gradIndex="5")  # -> customColors; plug-in component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
addition_4 = Addition(A=lng, B=1)
legendpar = Ladybug_LegendParameters(numSegments=addition_4, customColors=flatten(gradientlibrary))  # -> legendPar; plug-in component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
toggle = BooleanToggle(True)
sunlighthoursanalysis_2 = Ladybug_SunlightHoursAnalysis(
    geometry=flatten(disable_ground_analysis),
    context=flatten(obstacle),
    gridSize="8",
    disFromBase="0.01",
    sunVectors=flatten(sunpath_2.sunVectors),
    timeStep=1,
    legendPar=flatten(legendpar),
    parallel=toggle,
    runIt=toggle)  # -> readMe, contextMesh, analysisMesh, testPts, testVec, port, sunlightHoursResult, sunlightHoursMesh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; plug-in component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

bbox_2 = BoundingBox(Content=reduce_mesh.Reduced, Plane=PlaneXY(0, 0, 0))  # -> Box, Box_2
level_curves_high = Slider(40, range=1..100)
debrep_2 = DeconstructBrep(Brep=bbox_2.Box)  # -> Faces, Edges, Vertices
item_8 = ListItem(List=debrep_2.Vertices, Index=3, Wrap=True)
contour = Contour(Shape=reduce_mesh.Reduced, Point=item_8, Direction=Vector(0, 0, 1), Distance=level_curves_high)  # -> flatten(Contours)

panel_34 = Panel("Bake")

# ----
# Calculate volume of removed material (m3)
close_mesh = CloseMesh(Mesh=reduce_mesh.Reduced, Quadrangulate=True)  # -> Closed, Amount, Openings, ResultBoolean

panel_35 = Panel("Build pv arrays")
vector_3 = Vector(Vector(0, 8.784883445, 0))
vector_4 = Vector(Vector(-32.18003507, 0, 0))
line_sdl_3 = LineSDL(Start=center_4.Center, Direction=vector_4, Length="2")
line_sdl_4 = LineSDL(Start=center_4.Center, Direction=vector_3, Length="2")
control_points_3 = ControlPoints(Curve=line_sdl_3)  # -> Points, Weights, Knots
control_points_4 = ControlPoints(Curve=line_sdl_4)  # -> Points, Weights, Knots
square_root_2 = SquareRoot(Value=panel_7)
remove_ends_3 = NiceRemoveEnds(L=control_points_3.Points)  # -> A, B, B_2
remove_ends_4 = NiceRemoveEnds(L=control_points_4.Points)  # -> A, B, B_2
round_2 = Round(Number=square_root_2)  # -> Nearest, Floor, Ceiling
addition_5 = Addition(A=round_2.Nearest, B="1")
vector_2pt_3 = Vector2Pt(PointA=remove_ends_4.A, PointB=remove_ends_4.B_2, Unitize=False)  # -> Vector, Length
vector_2pt_4 = Vector2Pt(PointA=remove_ends_3.A, PointB=remove_ends_3.B_2, Unitize=False)  # -> Vector, Length
move_3 = Move(Geometry=line_sdl_3, Motion=vector_2pt_3.Vector)  # -> Geometry, Transform
move_4 = Move(Geometry=line_sdl_4, Motion=vector_2pt_4.Vector)  # -> Geometry, Transform
number_slider_12 = Slider(0.01, range=0..1)
vector_xyz_6 = VectorXYZ(XComponent=number_slider_12, YComponent=number_slider_12, ZComponent=number_slider_12)  # -> Vector, Length
boundary_surfaces_2 = BoundarySurfaces(Edges=[line_sdl_4, line_sdl_3, move_4.Geometry, move_3.Geometry])
center_9 = Center(Geometry=boundary_surfaces_2)  # -> Center, Dimension
scale_6 = Scale(Geometry=boundary_surfaces_2, Center=center_9.Center, Factor="1.4")  # -> Geometry, Transform
vector_xyz_7 = VectorXYZ(XComponent=0, YComponent=0, ZComponent="1")  # -> Vector, Length

panel_36 = Panel("Orient solar PV")
tof = Ladybug_TiltAndOrientationFactor(
    epwFile=epw_file,
    PV_SWHsurface=boundary_surfaces_2,
    annualShading=0,
    north=0,
    precision="12",
    scale=1,
    bakeIt=False,
    runIt=orient_solar_array)  # -> out, port, TOF, TSRF, PVsurfaceTilt, PVsurfaceAzimuth, optimalTilt, optimalAzimuth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; plug-in component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
radians_2 = Radians(Degrees=tof.optimalAzimuth)
radians_3 = Radians(Degrees=tof.optimalTilt)
line_sdl_5 = LineSDL(Start=center_9.Center, Direction=Vector(0, 0, 1), Length=1)
negative = Negative(Value=radians_3)
rotate_axis = RotateAxis(Geometry=boundary_surfaces_2, Angle=radians_2, Axis=line_sdl_5)  # -> Geometry, Transform
brep_wireframe = BrepWireframe(Brep=rotate_axis.Geometry, Density=-1)
explode_2 = Explode(Curve=brep_wireframe, Recursive=True)  # -> flatten(Segments), Vertices
item_9 = ListItem(List=explode_2.Segments, Index=Slider(0, range=-10..10), Wrap=True)
item_10 = ListItem(List=explode_2.Segments, Index=Slider(2, range=-10..10), Wrap=True)
curve_middle = CurveMiddle(Curve=item_9)
curve_middle_2 = CurveMiddle(Curve=item_10)
line = Line(StartPoint=curve_middle, EndPoint=curve_middle_2)
rotate_axis_2 = RotateAxis(Geometry=rotate_axis.Geometry, Angle=negative, Axis=line)  # -> Geometry, Transform
number_slider_13 = Slider(0, range=0..10)
vector_xyz_8 = VectorXYZ(XComponent=number_slider_13, YComponent=number_slider_13, ZComponent=Slider(0.07, range=0..10))  # -> Vector, Length
extrude_4 = Extrude(Base=rotate_axis_2.Geometry, Direction=vector_xyz_8.Vector)

rectangular_array_2 = RectangularArray(Geometry=extrude_4, Cell=scale_6.Geometry, XCount=round_2.Nearest, YCount=addition_5)  # -> Geometry, Transform
extrude_5 = Extrude(Base=rectangular_array_2.Geometry, Direction=vector_xyz_6.Vector)
geometry_2 = Geometry(extrude_5)
center_10 = Center(Geometry=geometry_2)  # -> Center, Dimension
project_point_2 = ProjectPoint(Point=center_10.Center, Direction=Vector(0, 0, -1), Geometry=reduce_mesh.Reduced)  # -> Point, Index
move_5 = Move(Geometry=project_point_2.Point, Motion=vector_xyz_7.Vector)  # -> Geometry, Transform
move_to_point_2 = MoveToPoint(Geometry=geometry_2, PointA=center_10.Center, PointB=move_5.Geometry)  # -> Moved, Vector, Transform
item_11 = ListItem(List=move_to_point_2.Moved, Index=Slider(0, range=-10..10), Wrap=True)
center_11 = Center(Geometry=item_11)  # -> Center, Dimension

panel_37 = Panel("Electrical lines")
radius = Panel("0.05")
mesh_brep_2 = MeshBrep(
    Brep=obstacle,
    Settings={GridMaxCount=0, GridMinCount=16, JaggedSeams=False, MaxEdgeLength=0, MinEdgeLength=0.0001, MinTolerance=0, Refine=True, RefineAngle=0, RelativeTolerance=0.65, SimplePlanes=True, Tolerance=0})
center_12 = Center(Geometry=item)  # -> Center, Dimension
greenhouse_connecti = Shortest_Walk(
    Person=center_6.Center,
    Interests=center_12.Center,
    Obstacles=mesh_brep_2,
    Terrain=flatten(reduce_mesh.Reduced),
    Sloping=Slider(160, range=0..1000))
shortest_walk = Shortest_Walk(
    Person=center_12.Center,
    Interests=center_11.Center,
    Obstacles=mesh_brep_2,
    Terrain=flatten(reduce_mesh.Reduced),
    Sloping=Slider(160, range=0..1000))
shortest_walk_2 = Shortest_Walk(
    Person=center_8.Center,
    Interests=center_12.Center,
    Obstacles=mesh_brep_2,
    Terrain=flatten(reduce_mesh.Reduced),
    Sloping=Slider(160, range=0..1000))
intcrv = Interpolate(Vertices=greenhouse_connecti, Degree=1, Periodic=False, KnotStyle=1)  # -> Curve, Length, Domain
intcrv_2 = Interpolate(Vertices=shortest_walk, Degree=1, Periodic=False, KnotStyle=1)  # -> Curve, Length, Domain
intcrv_3 = Interpolate(Vertices=shortest_walk_2, Degree=1, Periodic=False, KnotStyle=1)  # -> Curve, Length, Domain
smooth_polyline = SmoothPolyline(Polyline=intcrv.Curve, Strength=1, Times=1)
smooth_polyline_2 = SmoothPolyline(Polyline=intcrv_2.Curve, Strength=1, Times=1)
smooth_polyline_3 = SmoothPolyline(Polyline=intcrv_3.Curve, Strength=1, Times=1)
pipe = Pipe(Curve=smooth_polyline, Radius=radius, Caps=0)
pipe_2 = Pipe(Curve=smooth_polyline_2, Radius=radius, Caps=0)
pipe_3 = Pipe(Curve=smooth_polyline_3, Radius=radius, Caps=0)

# ----
# Build tube between modules
brep_edges = BrepEdges(Brep=cap_holes_3)  # -> Naked, Interior, NonManifold
brep_edges_2 = BrepEdges(Brep=rotate_3d.Geometry)  # -> Naked, Interior, NonManifold
list_item = ListItem(List=brep_edges.Interior, Index=0, Wrap=True)
explode_3 = Explode(Curve=list_item, Recursive=True)  # -> Segments, Vertices
explode_4 = Explode(Curve=brep_edges_2.Interior, Recursive=True)  # -> Segments, Vertices
list_item_2 = ListItem(List=explode_3.Vertices, Index=0, Wrap=True)
graft_tree = GraftTree(Tree=explode_4.Vertices, IncludeEmptyLists=True, IncludeNullItems=True)
line_2 = Line(StartPoint=list_item_2, EndPoint=center_6.Center)
evaluate_curve = EvaluateCurve(Curve=line_2, Parameter=Slider(0.5, range=0..100))  # -> Point, Tangent, Angle

branch_by_index = BranchByIndex(Tree=graft_tree, Branch=Slider(15, range=0..100))

line_3 = Line(StartPoint=center_8.Center, EndPoint=branch_by_index)
evaluate_curve_2 = EvaluateCurve(Curve=line_3, Parameter=Slider(0.5, range=0..100))  # -> Point, Tangent, Angle
line_4 = Line(StartPoint=evaluate_curve_2.Point, EndPoint=evaluate_curve.Point)
pipe_4 = Pipe(Curve=line_4, Radius=Slider(1, range=0..10), Caps=Slider(1, range=0..1))
solid_difference_2 = SolidDifference(BrepsA=pipe_4, BrepsB=flatten([rotate_3d.Geometry, cap_holes_3]))
cap_holes_4 = CapHoles(Brep=solid_difference_2)
item_selector_5 = ItemSelector(cap_holes_4, {"Closed Brep"}, selected="Closed Brep")

mesh_brep_3 = MeshBrep(
    Brep=[item_selector_5, cap_holes_3, rotate_3d.Geometry],
    Settings={GridMaxCount=0, GridMinCount=16, JaggedSeams=False, MaxEdgeLength=0, MinEdgeLength=0.0001, MinTolerance=0, Refine=True, RefineAngle=0, RelativeTolerance=0.65, SimplePlanes=True, Tolerance=0})
brep_2 = Brep(flatten([rotate_3d.Geometry, item_selector_5, pipe, pipe_2, pipe_3, cap_holes_3, linear_array.Geometry, move_to_point_2.Moved]))

mesh_difference = MeshDifference(MeshesA=mesh_brep_3, MeshesB=close_mesh.Closed)
volume = Volume(Geometry=flatten(mesh_brep_3))  # -> Volume, Centroid
volume_2 = Volume(Geometry=flatten(mesh_difference))  # -> Volume, Centroid
mass_addition_3 = MassAddition(Input=volume.Volume)  # -> Result, PartialResults
mass_addition_4 = MassAddition(Input=volume_2.Volume)  # -> Result, PartialResults
subtraction = Subtraction(A=mass_addition_3.Result, B=mass_addition_4.Result)
panel_38 = Panel(subtraction)

panel_39 = Panel("Radiation Analysis ")
radiationanalysis_2 = Ladybug_RadiationAnalysis(
    geometry=flatten(item_11),
    context=flatten(obstacle),
    gridSize=slider,
    disFromBase=number_slider_9,
    orientationStudyP=flatten(orientationstudypar),
    selectedSkyMtx=flatten(selectskymtx.selectedSkyMtx),
    parallel=cumulative_radiation_over_a_given_period,
    runIt=cumulative_radiation_over_a_given_period)  # -> out, contextMesh, analysisMesh, testPts, testVec, port, radiationResult, radiationMesh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; plug-in component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
radiationanalysis_3 = Ladybug_RadiationAnalysis(
    geometry=flatten([cap_holes_3, rotate_3d.Geometry, item_selector_5]),
    context=flatten(obstacle),
    gridSize=slider,
    disFromBase=number_slider_9,
    orientationStudyP=flatten(orientationstudypar),
    selectedSkyMtx=flatten(selectskymtx.selectedSkyMtx),
    parallel=cumulative_radiation_over_a_given_period,
    runIt=cumulative_radiation_over_a_given_period)  # -> contextMesh, analysisMesh, testPts, testVec, port, radiationResult, radiationMesh, radiationLegend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; plug-in component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
center_13 = Center(Geometry=radiationanalysis_2.radiationMesh)  # -> Center, Dimension
scale_7 = Scale(Geometry=radiationanalysis_2.radiationMesh, Center=center_13.Center, Factor=Slider(2, range=0..100))  # -> Geometry, Transform

panel_40 = Panel("Ground analysis")
explode_5 = MeshExplode(Mesh=disable_ground_analysis, Interpolate=False)
facen = FaceNormals(Mesh=explode_5)  # -> flatten(Centers), flatten(Normals)
xy_2 = XYPlane(Origin=flatten(facen.Centers))
project = Project(Geometry=facen.Normals, Plane=xy_2)  # -> Geometry, Transform
addition_6 = Addition(A=facen.Centers, B=facen.Normals)
pdecon = Deconstruct(Point=flatten(facen.Centers))  # -> XComponent, YComponent, ZComponent
angle = Angle(VectorA=flatten(facen.Normals), VectorB=flatten(project.Geometry))  # -> Angle, Reflex
data = Data(Vector(0, 0, 1))
sort_3 = SortList(Keys=pdecon.ZComponent)  # -> reverse(Keys), ValuesA
addition_7 = Addition(A=addition_6, B=data)
deg = Degrees(Radians=angle.Angle)
item_12 = ListItem(List=sort_3.Keys, Index=0, Wrap=True)
expression_3 = Expression(x=deg, Expression="abs(round((90-x),1))")
pl_3pt = Plane3Pt(PointA=facen.Centers, PointB=addition_6, PointC=addition_7)
deplane = DeconstructPlane(Plane=pl_3pt)  # -> Origin, XAxis, YAxis, ZAxis
dom_2 = ConstructDomain(DomainStart="0", DomainEnd="90")
bnd = Bounds(Numbers=pdecon.ZComponent)
dom_3 = ConstructDomain(DomainStart="0", DomainEnd="100")
remap = RemapNumbers(Value=expression_3, Source=dom_2, Target=dom_3)  # -> graft(Mapped), Clipped
remap_2 = RemapNumbers(Value=pdecon.ZComponent, Source=bnd, Target=dom_3)  # -> graft(Mapped), Clipped
avr = Average(Input=[remap_2.Mapped, remap.Mapped])  # -> flatten(ArithmeticMean)

gradient = Gradient(
    LowerLimit="0",
    UpperLimit="90",
    Parameter=expression_3,
    stops=[0: RGB(4, 3, 25), 0: RGB(192, 192, 192), 0.0138: RGB(192, 192, 192), 0.0646: RGB(255, 192, 128), 0.102: RGB(255, 128, 0), 1: RGB(128, 0, 0)])
concat = Concatenate(FragmentA=expression_3, FragmentB="°")
preview_3 = CustomPreview(Geometry=explode_5, Material=gradient)
tag = TextTag3D(Location=flatten(addition_6), Text=concat, Size=Slider(5, range=0..3000), Colour=gradient, Justification=7)

gradient_2 = Gradient(
    LowerLimit=item_12,
    UpperLimit="-20",
    Parameter=pdecon.ZComponent,
    stops=[0.296: RGB(0, 128, 0), 0.585: RGB(0, 255, 0), 0.76: RGB(192, 255, 192), 0.887: RGB(173, 203, 249), 1: RGB(75, 107, 169)])
preview_4 = CustomPreview(Geometry=explode_5, Material=gradient_2)

gradient_3 = Gradient(
    LowerLimit="100",
    UpperLimit="-20",
    Parameter=avr,
    stops=[0: RGB(234, 38, 0), 0.25: RGB(234, 126, 0), 0.5: RGB(254, 244, 84), 0.884: RGB(173, 203, 249), 1: RGB(75, 107, 169)])

amp = Amplitude(Vector=deplane.YAxis, Amplitude=Slider(402, range=0..500))
addition_8 = Addition(A=deplane.Origin, B=amp)
mesh_closest_point = MeshClosestPoint(Point=addition_8, Mesh=disable_ground_analysis)  # -> Point, Index, Parameter

vec2pt_2 = Vector2Pt(PointA=mesh_closest_point.Point, PointB=deplane.Origin, Unitize=False)  # -> Vector, Length
vdisex = VectorDisplayEx(Point=deplane.Origin, Vector=vec2pt_2.Vector, Colour=gradient_3, Width=Slider(7.594, range=0..45))

# ==== cluster NiceRemoveEnds: Removes a list's start and end
L = ClusterInput()
lng = ListLength(List=L)
split = SplitList(List=L, Index=expr("x-1", lng))  # -> ListA, flatten(ListB)
split_2 = SplitList(List=split.ListA, Index=1)  # -> flatten(ListA), flatten(ListB)
A = ClusterOutput(split_2.ListA)
B = ClusterOutput(split_2.ListB)
B_2 = ClusterOutput(split.ListB)

# ==== cluster Att_toR
B = ClusterInput()
att = ClusterInput()
att_2 = Attributes(att)
prgm = Programme(Attributes=att_2)  # -> Tags, Areas, Colors, Legends
expression = Expression(x=prgm.Areas, Expression="Sqrt(x/π)")
multiplication = Multiplication(A=expression, B=B)
material = CreateMaterial(Diffuse=prgm.Colors, Specular=RGB(255, 255, 255), Emission=RGB(0, 0, 0), Transparency=0.5, Shine=0)
M = ClusterOutput(material)
R = ClusterOutput(multiplication)
