# Grasshopper definition Mars base Rhino inside Revit 1.3.gh (Grasshopper 1.0.7)
# Copyright: Distribution, modification and/or and copies are not allowed
# plug-ins: Rhino.Inside for Autodesk Revit, jSwan, Antflow, Human, TT Toolbox, CenterOfMass, Heteroptera, BullAnt, MeshEdit Components, Pufferfish

# ----
# Please reference the original author when using this code
# Monsieur Thomas LAGARDE
# Linkedin https://www.linkedin.com/in/thomas-lagarde
# Projects https://www.researchgate.net/profile/Thomas-Lagarde
# Portfolio https://issuu.com/spacearchitecture
# 
# For any inquiries/bugs/others email me at thomas.lagarde@outlook.com
panel = Panel("""Mars Base Rhino: A Plugin for Environmental Analysis

Copyright (C) 2021, MONSIEUR THOMAS LAGARDE

This program is free software; you can redistribute it and/or modify it  except for the company called Interstellar Lab under the terms of the GNU General Public License as published by the Free Software Foundation; either version 3 of the License, or (at your option) any later version.

This program is distributed in the hope that it will be useful, but WITHOUT ANY WARRANTY; without even the implied warranty of MERCHANTABILITY or FITNESS FOR A PARTICULAR PURPOSE. See the GNU General Public License for more details.

You should have received a copy of the GNU General Public License along with this program; if not, see <http://www.gnu.org/licenses>.

Additional permission under GNU GPL version 3 section 7:

Mars Base Rhino uses the Rhinoceros RhinoCommon and Grasshopper libraries, which come with/for Rhinoceros 5.0. Mars Base Rhino depends fundamentally on the use of Rhinoceros and Grasshopper, and so Rhinocommon, Grasshopper and all associated libraries are assumed to be “System Libraries” as defined by the GPL, and thus are excluded from this license.
Please contact McNeel & Associates for further information.

http://www.en.na.mcneel.com/

Mars Base Rhino uses Radiance’s gendaymtx.exe, which is subject to its own licensing condition. Radiance software (http://radsite.lbl.gov/) developed by the Lawrence Berkeley National Laboratory  (http://www.lbl.gov/). Please refer to Radiance’s github page for more information:

https://github.com/NREL/Radiance

Mars Base Rhino uses formulas for PMV and Adatptive comfort models that have been developed by many scientists over several decades and have been published in the ASHRAE55 and EN-15251 international standards.  The code for these formulas has been re-written in Python by Chris Mackey based on the javascript version in the Center for the Built Environment’s Thermal Comfort Tool developed by Hoyt, Tyler; Schiavon, Stefano; Piccioli, Alberto; Moon, Dustin; and Steinfeld, Kyle (2013).  The CBE Comfor Tool is subject to a GPL licence.  For more information, see the Comfort Tool website or the Comfort Tool github:

http://cbe.berkeley.edu/comforttool/ , https://github.com/CenterForTheBuiltEnvironment/comfort_tool

Mars Base Rhino uses mathematical formulas developed by the UTCI (Universal Thermal Climate Index) project. The UTCI code in Mars Base Rhino was re-written in Python by Chris Mackey based on the original F90 UTCI source code of Peter Broede, IfADo - Leibniz Research Centre for Working Environment and Human Factors at Dortmund Technical University, Germany. UTCI is subjected to it’s own license. Please refer to UTCI website for more information:

http://www.utci.org/utci_doku.php

Mars Base Rhino uses fortran code written by Peter Hoeppe to calculate Physiological Equivalent Temperature. The code is re-written in Python by Djordje Spasic and is used to calculate “Physiological Equivalent Temperature” thermal comfort index in “Thermal comfort indices” component. Please refer to the original code at:

http://www.pland.gov.hk/pland_en/p_study/prog_s/ucmapweb/ucmap_project/content/reports/Comfort_Level_Survey.pdf

Mars Base Rhino uses Quick Basic code written by Jacques Malchaire to calculate Predicted Heat Strain. The code is re-written in Python by Djordje Spasic and is used to calculate “Predicted Heat Strain” thermal comfort index in “Thermal comfort indices” component. Please refer to the original code at:

http://www.deparisnet.be/chaleur/Normes/Malchaire_PHS_Predicted_Heat_Strain_standard%207933_22-7-13.pdf

Mars Base Rhino uses Geomag 0.9.2015 source code to calculate True North. Geomag is originally developed by Christopher Weiss, and has been modified by Djordje Spasic. Geomag is subject to the LGPL. For more information refer to the project Page.

https://pypi.python.org/pypi/geomag

Mars Base Rhino uses Lambert W function code written in python by user: “FB36” from http://code.activestate.com. The code is used to calculate Maximum power voltage and Maximum power current for Mars Base Rhino Photovoltaics components. Please refer to the original code at:

http://code.activestate.com/recipes/577729-lambert-w-function

Mars Base Rhino uses an excerpt of code written in R by Nick Burns to calculate natural wet bulb temperature. The code is re-written in Python by Djordje Spasic and is used to calculate “WBGT indoors” thermal comfort index in “Thermal comfort indices” component. Please refer to the original code at github repository.

https://github.com/nickb-/Calculating-WBGT/blob/master/relaxation_Tw/working_code/wbgt.R

Mars Base Rhino uses python code written by Clement Greiner to calculate an area of mesh faces. The code is used in “Mars Base Rhino_Mars Base Rhino” component. Please refer to the original code at:

http://discourse.mcneel.com/t/area-of-mesh-face/26609

---------------------------------------------------------------------------------------------------------------------------

GNU GENERAL PUBLIC LICENSE

Version 3, 29 June 2007

Copyright © 2007 Free Software Foundation, Inc. <http://fsf.org/>

Everyone is permitted to copy and distribute verbatim copies of this license document except for the company called Interstellar Lab, but changing it is not allowed.

Preamble

The GNU General Public License is a free, copyleft license for software and other kinds of works.

The licenses for most software and other practical works are designed to take away your freedom to share and change the works. By contrast, the GNU General Public License is intended to guarantee your freedom to share and change all versions of a program--to make sure it remains free software for all its users. We, the Free Software Foundation, use the GNU General Public License for most of our software; it applies also to any other work released this way by its authors. You can apply it to your programs, too.

When we speak of free software, we are referring to freedom, not price. Our General Public Licenses are designed to make sure that you have the freedom to distribute copies of free software (and charge for them if you wish), that you receive source code or can get it if you want it, that you can change the software or use pieces of it in new free programs, and that you know you can do these things.

To protect your rights, we need to prevent others from denying you these rights or asking you to surrender the rights. Therefore, you have certain responsibilities if you distribute copies of the software, or if you modify it: responsibilities to respect the freedom of others.

For example, if you distribute copies of such a program, whether gratis or for a fee, you must pass on to the recipients the same freedoms that you received. You must make sure that they, too, receive or can get the source code. And you must show them these terms so they know their rights.

Developers that use the GNU GPL protect your rights with two steps: (1) assert copyright on the software, and (2) offer you this License giving you legal permission to copy, distribute and/or modify it.

For the developers’ and authors’ protection, the GPL clearly explains that there is no warranty for this free software. For both users’ and authors’ sake, the GPL requires that modified versions be marked as changed, so that their problems will not be attributed erroneously to authors of previous versions.

Some devices are designed to deny users access to install or run modified versions of the software inside them, although the manufacturer can do so. This is fundamentally incompatible with the aim of protecting users’ freedom to change the software. The systematic pattern of such abuse occurs in the area of products for individuals to use, which is precisely where it is most unacceptable. Therefore, we have designed this version of the GPL to prohibit the practice for those products. If such problems arise substantially in other domains, we stand ready to extend this provision to those domains in future versions of the GPL, as needed to protect the freedom of users.

Finally, every program is threatened constantly by software patents. States should not allow patents to restrict development and use of software on general-purpose computers, but in those that do, we wish to avoid the special danger that patents applied to a free program could make it effectively proprietary. To prevent this, the GPL assures that patents cannot be used to render the program non-free.

The precise terms and conditions for copying, distribution and modification follow.

TERMS AND CONDITIONS

0. Definitions.

“This License” refers to version 3 of the GNU General Public License.

“Copyright” also means copyright-like laws that apply to other kinds of works, such as semiconductor masks.

“The Program” refers to any copyrightable work licensed under this License. Each licensee is addressed as “you”. “Licensees” and “recipients” may be individuals or organizations.

To “modify” a work means to copy from or adapt all or part of the work in a fashion requiring copyright permission, other than the making of an exact copy. The resulting work is called a “modified version” of the earlier work or a work “based on” the earlier work.

A “covered work” means either the unmodified Program or a work based on the Program.

To “propagate” a work means to do anything with it that, without permission, would make you directly or secondarily liable for infringement under applicable copyright law, except executing it on a computer or modifying a private copy. Propagation includes copying, distribution (with or without modification), making available to the public, and in some countries other activities as well.

To “convey” a work means any kind of propagation that enables other parties to make or receive copies. Mere interaction with a user through a computer network, with no transfer of a copy, is not conveying.

An interactive user interface displays “Appropriate Legal Notices” to the extent that it includes a convenient and prominently visible feature that (1) displays an appropriate copyright notice, and (2) tells the user that there is no warranty for the work (except to the extent that warranties are provided), that licensees may convey the work under this License, and how to view a copy of this License. If the interface presents a list of user commands or options, such as a menu, a prominent item in the list meets this criterion.

1. Source Code.

The “source code” for a work means the preferred form of the work for making modifications to it. “Object code” means any non-source form of a work.

A “Standard Interface” means an interface that either is an official standard defined by a recognized standards body, or, in the case of interfaces specified for a particular programming language, one that is widely used among developers working in that language.

The “System Libraries” of an executable work include anything, other than the work as a whole, that (a) is included in the normal form of packaging a Major Component, but which is not part of that Major Component, and (b) serves only to enable use of the work with that Major Component, or to implement a Standard Interface for which an implementation is available to the public in source code form. A “Major Component”, in this context, means a major essential component (kernel, window system, and so on) of the specific operating system (if any) on which the executable work runs, or a compiler used to produce the work, or an object code interpreter used to run it.

The “Corresponding Source” for a work in object code form means all the source code needed to generate, install, and (for an executable work) run the object code and to modify the work, including scripts to control those activities. However, it does not include the work’s System Libraries, or general-purpose tools or generally available free programs which are used unmodified in performing those activities but which are not part of the work. For example, Corresponding Source includes interface definition files associated with source files for the work, and the source code for shared libraries and dynamically linked subprograms that the work is specifically designed to require, such as by intimate data communication or control flow between those subprograms and other parts of the work.

The Corresponding Source need not include anything that users can regenerate automatically from other parts of the Corresponding Source.

The Corresponding Source for a work in source code form is that same work.

2. Basic Permissions.

All rights granted under this License are granted for the term of copyright on the Program, and are irrevocable provided the stated conditions are met. This License explicitly affirms your unlimited permission to run the unmodified Program except for the company called Interstellar Lab. The output from running a covered work is covered by this License only if the output, given its content, constitutes a covered work. This License acknowledges your rights of fair use or other equivalent, as provided by copyright law.

You may make, run and propagate covered works that you do not convey, without conditions so long as your license otherwise remains in force. You may convey covered works to others for the sole purpose of having them make modifications exclusively for you, or provide you with facilities for running those works, provided that you comply with the terms of this License in conveying all material for which you do not control copyright. Those thus making or running the covered works for you must do so exclusively on your behalf, under your direction and control, on terms that prohibit them from making any copies of your copyrighted material outside their relationship with you.

Conveying under any other circumstances is permitted solely under the conditions stated below. Sublicensing is not allowed; section 10 makes it unnecessary.

3. Protecting Users’ Legal Rights From Anti-Circumvention Law.

No covered work shall be deemed part of an effective technological measure under any applicable law fulfilling obligations under article 11 of the WIPO copyright treaty adopted on 20 December 1996, or similar laws prohibiting or restricting circumvention of such measures.

When you convey a covered work, you waive any legal power to forbid circumvention of technological measures to the extent such circumvention is effected by exercising rights under this License with respect to the covered work, and you disclaim any intention to limit operation or modification of the work as a means of enforcing, against the work’s users, your or third parties’ legal rights to forbid circumvention of technological measures.

4. Conveying Verbatim Copies.

You may convey verbatim copies of the Program’s source code as you receive it, in any medium except for the company called Interstellar Lab, provided that you conspicuously and appropriately publish on each copy an appropriate copyright notice; keep intact all notices stating that this License and any non-permissive terms added in accord with section 7 apply to the code; keep intact all notices of the absence of any warranty; and give all recipients a copy of this License along with the Program.

You may charge any price or no price for each copy that you convey, and you may offer support or warranty protection for a fee.

5. Conveying Modified Source Versions.

You may convey a work based on the Program except for the company called Interstellar Lab, or the modifications to produce it from the Program, in the form of source code under the terms of section 4, provided that you also meet all of these conditions:

    * a) The work must carry prominent notices stating that you modified it, and giving a relevant date.
    * b) The work must carry prominent notices stating that it is released under this License and any conditions added under section 7. This requirement modifies the requirement in section 4 to “keep intact all notices”.
    * c) You must license the entire work, as a whole, under this License to anyone who comes into possession of a copy. This License will therefore apply, along with any applicable section 7 additional terms, to the whole of the work, and all its parts, regardless of how they are packaged. This License gives no permission to license the work in any other way, but it does not invalidate such permission if you have separately received it.
    * d) If the work has interactive user interfaces, each must display Appropriate Legal Notices; however, if the Program has interactive interfaces that do not display Appropriate Legal Notices, your work need not make them do so.

A compilation of a covered work with other separate and independent works, which are not by their nature extensions of the covered work, and which are not combined with it such as to form a larger program, in or on a volume of a storage or distribution medium, is called an “aggregate” if the compilation and its resulting copyright are not used to limit the access or legal rights of the compilation’s users beyond what the individual works permit. Inclusion of a covered work in an aggregate does not cause this License to apply to the other parts of the aggregate.

6. Conveying Non-Source Forms.

You may convey a covered work in object code form under the terms of sections 4 and 5, provided that you also convey the machine-readable Corresponding Source under the terms of this License, in one of these ways:

    * a) Convey the object code in, or embodied in, a physical product (including a physical distribution medium), accompanied by the Corresponding Source fixed on a durable physical medium customarily used for software interchange.
    * b) Convey the object code in, or embodied in, a physical product (including a physical distribution medium), accompanied by a written offer, valid for at least three years and valid for as long as you offer spare parts or customer support for that product model, to give anyone who possesses the object code either (1) a copy of the Corresponding Source for all the software in the product that is covered by this License, on a durable physical medium customarily used for software interchange, for a price no more than your reasonable cost of physically performing this conveying of source, or (2) access to copy the Corresponding Source from a network server at no charge.
    * c) Convey individual copies of the object code with a copy of the written offer to provide the Corresponding Source. This alternative is allowed only occasionally and noncommercially, and only if you received the object code with such an offer, in accord with subsection 6b.
    * d) Convey the object code by offering access from a designated place (gratis or for a charge), and offer equivalent access to the Corresponding Source in the same way through the same place at no further charge. You need not require recipients to copy the Corresponding Source along with the object code. If the place to copy the object code is a network server, the Corresponding Source may be on a different server (operated by you or a third party) that supports equivalent copying facilities, provided you maintain clear directions next to the object code saying where to find the Corresponding Source. Regardless of what server hosts the Corresponding Source, you remain obligated to ensure that it is available for as long as needed to satisfy these requirements.
    * e) Convey the object code using peer-to-peer transmission, provided you inform other peers where the object code and Corresponding Source of the work are being offered to the general public at no charge under subsection 6d.

A separable portion of the object code, whose source code is excluded from the Corresponding Source as a System Library, need not be included in conveying the object code work.

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""")

# ----
# Plugin Libraries Used: SpaceSyntaxDesign_GH | ver: 1.0.0.1
# Parakeet | ver:
# jSwan | ver: 1.2.0
# Antflow | ver:
# Human | ver: 1.3.1
# TT Toolbox | ver: 1.9.6353.28734
# Pufferfish | ver: 2.9.0.0
# Heteroptera | ver: 0.5.2.6
# MeshEdit Components | ver: 2.0.0.0
# All Components Used: Fri Aug 27 06:34:45 2021
# Last saved by - tlagarde
# Total Components - 479
# Heteroptera:
# ...Geometry:
# ......Center - 13
# TT Toolbox:
# ...TT Tools:
# ......Tree Branch Index - 1
# Human:
# ...Misc:
# ......Item Selector - 5
# Surface:
# ...Util:
# ......Cap Holes - 4
# ...Primitive:
# ......Cylinder - 1
# ......Bounding Box - 1
# ...Freeform:
# ......Boundary Surfaces - 2
# ......Extrude - 4
# ......Pipe - 4
# ...Analysis:
# ......Volume - 2
# ......Deconstruct Brep - 3
# ......Brep Wireframe - 1
# ......Brep Edges - 2
# Parakeet:
# ...Primitive:
# ......Geodesic Dome - 1
# Display:
# ...Preview:
# ......Custom Preview - 2
# ...Dimensions:
# ......Text Tag - 7
# ......Text Tag 3D - 1
# ...Vector:
# ......Vector Display Ex - 1
# OTools:
# ...3 | Debugging:
# ......OTools_GetComponents2 - 2
# Maths:
# ...Script:
# ......Tolerance - 1
# ......Expression - 2
# ...Polynomials:
# ......Square Root - 8
# ...Domain:
# ......Construct Domain - 2
# ......Bounds - 1
# ......Remap Numbers - 2
# ...Trig:
# ......Degrees - 1
# ......Radians - 3
# ...Util:
# ......Round - 8
# ......Average - 1
# ...Operators:
# ......Mass Addition - 2
# ......Addition - 13
# ......Subtraction - 1
# ......Multiplication - 3
# ......Division - 8
# Ladybug:
# ...2 | VisualizeWeatherData:
# ......Ladybug_selectSkyMtx - 1
# Mesh:
# ...Util:
# ......Mesh Brep - 3
# ...Analysis:
# ......Mesh Explode - 1
# ......Face Normals - 1
# ......Mesh Closest Point - 1
# SpaceSyntax:
# ...Utilities:
# ......Programme - 1
# ...GraphDrawing:
# ......ForceDirectedDrawing - 1
# ...GRep:
# ......GraphFromNodes&Links - 1
# jSwan:
# ...jSwan:
# ......Deserialize Keys and Values - 1
# ......Deserialize Json - 11
# Sets:
# ...List:
# ......Split List - 2
# ......Sort List - 3
# ......Reverse List - 2
# ......List Item - 32
# ...Text:
# ......Text Split - 3
# ......Concatenate - 1
# ...Tree:
# ......Graft Tree - 1
# ......Explode Tree - 1
# ...Sets:
# ......Member Index - 2
# ......Key/Value Search - 3
# ......Create Set - 2
# Params:
# ...Geometry:
# ......Brep - 8
# ......Geometry - 2
# ......Mesh - 3
# ......Vector - 4
# ...Util:
# ......Nice Remove Ends - 4
# ......Scribble - 10
# ......Cluster - 12
# ...Primitive:
# ......Data - 1
# ......File Path - 2
# ...Input:
# ......Panel - 69
# ......Button - 1
# ......Boolean Toggle - 6
# ......Gradient - 3
# ......Number Slider - 75
# LB-Legacy:
# ...4 | Renewables:
# ......Ladybug_Tilt And Orientation Factor - 1
# ...0 | Ladybug:
# ......Ladybug_Import epw - 1
# ......Ladybug_Ladybug - 1
# ...5 | Extra:
# ......Ladybug_Orientation Study Parameters - 1
# ...3 | EnvironmentalAnalysis:
# ......Ladybug_Sunlight Hours Analysis - 1
# ......Ladybug_Radiation Analysis - 3
# ...2 | VisualizeWeatherData:
# ......Ladybug_GenCumulativeSkyMtx - 1
# ......Ladybug_Wind Rose - 1
# ......Ladybug_SunPath - 1
# Pufferfish:
# ...Transform:
# ......Move To Point - 2
# ...Mesh:
# ......Close Mesh - 1
# ......Reduce Mesh - 1
# ...Surface:
# ......Extrude Tapered Polysurface - 1
# Vector:
# ...Plane:
# ......Align Plane - 1
# ......XY Plane - 1
# ......Deconstruct Plane - 1
# ......Plane 3Pt - 1
# ...Vector:
# ......Vector XYZ - 7
# ......Vector 2Pt - 6
# ......Angle - 1
# ......Amplitude - 1
# ...Point:
# ......Pull Point - 2
# ......Deconstruct - 1
# ......Project Point - 2
# Curve:
# ...Primitive:
# ......Rectangle - 1
# ......Line - 4
# ......Circle CNR - 1
# ......Line SDL - 6
# ...Util:
# ......Smooth Polyline - 3
# ......Explode - 4
# ...Spline:
# ......Interpolate - 3
# ...Analysis:
# ......Curve Middle - 2
# ......Control Points - 4
# ......Evaluate Curve - 2
# ......End Points - 1
# AntFlow:
# ...Flow:
# ......Shortest_Walk - 3
# Transform:
# ...Euclidean:
# ......Rotate 3D - 1
# ......Rotate Axis - 2
# ......Move - 4
# ...Array:
# ......Linear Array - 1
# ......Rectangular Array - 2
# ...Affine:
# ......Scale NU - 1
# ......Scale - 2
# ......Project - 1
# Intersect:
# ...Mathematical:
# ......Contour - 1
# ...Shape:
# ......Mesh Split - 1
# ......Solid Difference - 1
# ......Mesh Difference - 1
o_getcomps2 = OTools_GetComponents2()  # inputs x: Boolean; plug-in component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

file_path = FilePath("F:\B&J-SICSA-SOM-IIT-ADPI-Spaceable-Mars City Design-HERMES-Boulder Associates\SICSA\Paper - Presentation\ICES 2021\SIMOC\Preset 4.json")
panel_2 = Panel("Read JSON file")
deserialize_json = DeserializeJson(JSON=file_path, OutputsLocked=False)  # -> README, Steps, Parameters, Total_consumption, Total_production, Total_agent_count, Agent_growth, Storage_ratios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
deserialize_json_2 = DeserializeJson(JSON=deserialize_json.Configuration, OutputsLocked=False)  # -> Location, Duration, Humans, Food, Eclss, PowerGeneration, PowerStorage, CrewQuarters, Greenhouse, PlantSpecies
deserialize_keys_and_values = DeserializeKeysAndValues(JSON=deserialize_json.Details_per_agent, Keys=Slider(100, range=1..901))  # -> Key, Value
panel_3 = Panel(deserialize_keys_and_values.Value)
deserialize_json_3 = DeserializeJson(JSON=deserialize_keys_and_values.Value, OutputsLocked=False)
deserialize_json_4 = DeserializeJson(JSON=deserialize_json_2.PowerStorage, OutputsLocked=False)  # -> Type, Amount, Units
deserialize_json_5 = DeserializeJson(JSON=deserialize_json_2.PowerGeneration, OutputsLocked=False)  # -> Type, Amount, Units
deserialize_json_6 = DeserializeJson(JSON=deserialize_json_2.Greenhouse, OutputsLocked=False)  # -> Type, Amount, Units
deserialize_json_7 = DeserializeJson(JSON=deserialize_json_2.CrewQuarters, OutputsLocked=False)  # -> Type, Amount, Units
deserialize_json_8 = DeserializeJson(JSON=deserialize_json_2.PlantSpecies, OutputsLocked=False)  # -> Type, Amount
deserialize_json_9 = DeserializeJson(JSON=deserialize_json_3, OutputsLocked=False)  # -> Enrg_kwh, Atmo_co2
panel_4 = Panel(deserialize_json_3)
panel_5 = Panel(deserialize_json_9.Enrg_kwh)
panel_6 = Panel(deserialize_json_5.Amount)
panel_7 = Panel(deserialize_json_5.Type)
panel_8 = Panel(deserialize_json_8.Type)
panel_9 = Panel(deserialize_json_8.Amount)
deserialize_json_10 = DeserializeJson(JSON=deserialize_json_9.Enrg_kwh, OutputsLocked=False)  # -> Solid_waste_aerobic_bioreactor, Multifiltration_purifier_post_treatment, Oxygen_generation_SFWE, Urine_recycling_processor_VCD, Co2_removal_SAWD, Co2_reduction_sabatier, Ch4_removal_agent, Dehumidifier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
deserialize_json_11 = DeserializeJson(JSON=deserialize_json_10.Oxygen_generation_SFWE, OutputsLocked=False)  # -> Value, Unit
panel_10 = Panel(deserialize_json_11.Value)

panel_11 = Panel("Revit connexion")
directshape_categories = DirectShapeCategories("autodesk.revit.category.family:mass-1.0.0")
terrain = GraphicalElement(<instanceelement referenced from the Revit model>)
contexte = Face(<face referenced from the Revit model>)
greenhouse = GraphicalElement(<familyinstance referenced from the Revit model>)
battery_storage = GraphicalElement(<familyinstance referenced from the Revit model>)
habitat = GraphicalElement(<familyinstance referenced from the Revit model>)
pv_array = GraphicalElement(<familyinstance referenced from the Revit model>)
element_geometry = ElementGeometry(Elements=terrain)  # -> flatten(Geometry)
boolean_toggle = BooleanToggle(True)
add_geometry_directshape = AddGeometryDirectShape(TrackingMode=2)  # disabled
remove_ends = NiceRemoveEnds(L=element_geometry)  # -> A, B, B_2
rebuild_mesh = RebuildMesh(
    Mesh=flatten(remove_ends.B_2),
    RebuildNormals=boolean_toggle,
    CullUnused=boolean_toggle,
    UnifyNormals=boolean_toggle,
    FlipNormals=False,
    IdenticalCombine=boolean_toggle,
    WeldVertices=boolean_toggle)
boolean_toggle_2 = BooleanToggle(False)
ggmeshtobrep = GgMeshToBrep(Mesh=rebuild_mesh, Collapse=boolean_toggle_2, Triangulate=boolean_toggle_2, Tol=Slider(0.1, range=-10..50))

panel_12 = Panel("WEATHER DATA")
cumulative_radiation_over_a_given_period = BooleanToggle(False)  # "Cumulative radiation over a given period in kWh/m2"
ladybug = Ladybug_Ladybug()  # -> out; plug-in component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
wind_rose = BooleanToggle(False)
orient_greenhouse = BooleanToggle(True)
orient_solar_array = BooleanToggle(True)
epw_file = FilePath("F:\B&J-SICSA-SOM-IIT-ADPI-Spaceable-Mars City Design-HERMES-Boulder Associates\Sam Pitroda\Portugal Project\Setubal site\PRT_Lisboa.085360_INETI.epw")

# ---- group: Obstacles
obstacle = Curve([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])

# ----
panel_13 = Panel("Ground analysis")
explode = MeshExplode(Mesh=rebuild_mesh, Interpolate=False)
facen = FaceNormals(Mesh=explode)  # -> flatten(Centers), flatten(Normals)
xy = XYPlane(Origin=flatten(facen.Centers))
project = Project(Geometry=facen.Normals, Plane=xy)  # -> Geometry, Transform
addition = Addition(A=facen.Centers, B=facen.Normals)
pdecon = Deconstruct(Point=flatten(facen.Centers))  # -> XComponent, YComponent, ZComponent
angle = Angle(VectorA=flatten(facen.Normals), VectorB=flatten(project.Geometry))  # -> Angle, Reflex
data = Data(Vector(0, 0, 1))
sort = SortList(Keys=pdecon.ZComponent)  # -> reverse(Keys), ValuesA
addition_2 = Addition(A=addition, B=data)
deg = Degrees(Radians=angle.Angle)
item = ListItem(List=sort.Keys, Index=0, Wrap=True)
expression = Expression(x=deg, Expression="abs(round((90-x),1))")
pl_3pt = Plane3Pt(PointA=facen.Centers, PointB=addition, PointC=addition_2)
deplane = DeconstructPlane(Plane=pl_3pt)  # -> Origin, XAxis, YAxis, ZAxis
dom = ConstructDomain(DomainStart="0", DomainEnd="90")
bnd = Bounds(Numbers=pdecon.ZComponent)
dom_2 = ConstructDomain(DomainStart="0", DomainEnd="100")
remap = RemapNumbers(Value=expression, Source=dom, Target=dom_2)  # -> graft(Mapped), Clipped
remap_2 = RemapNumbers(Value=pdecon.ZComponent, Source=bnd, Target=dom_2)  # -> graft(Mapped), Clipped
amp = Amplitude(Vector=deplane.YAxis, Amplitude=Slider(10, range=0..10))
addition_3 = Addition(A=deplane.Origin, B=amp)
avr = Average(Input=[remap_2.Mapped, remap.Mapped])  # -> flatten(ArithmeticMean)
mesh_closest_point = MeshClosestPoint(Point=addition_3, Mesh=rebuild_mesh)  # -> Point, Index, Parameter

# ----
# 0.5
# 35°
# Slope in degrees
# gray = above 2° slope (horizontal plane)
# red = over 35° slope
panel_14 = Panel("°")
gradient = Gradient(
    LowerLimit="0",
    UpperLimit="90",
    Parameter=expression,
    stops=[0: RGB(4, 3, 25), 0: RGB(192, 192, 192), 0.0138: RGB(192, 192, 192), 0.0646: RGB(255, 192, 128), 0.102: RGB(255, 128, 0), 1: RGB(128, 0, 0)])
concat = Concatenate(FragmentA=expression, FragmentB=panel_14)
preview = CustomPreview(Geometry=explode, Material=gradient)
tag = TextTag3D(Location=flatten(addition), Text=concat, Size=Slider(1, range=0..3000), Colour=gradient, Justification=7)

# ----
# Water flow vectors
gradient_2 = Gradient(
    LowerLimit="100",
    UpperLimit="-20",
    Parameter=avr,
    stops=[0: RGB(234, 38, 0), 0.25: RGB(234, 126, 0), 0.5: RGB(254, 244, 84), 0.884: RGB(173, 203, 249), 1: RGB(75, 107, 169)])
vec2pt = Vector2Pt(PointA=mesh_closest_point.Point, PointB=deplane.Origin, Unitize=False)  # -> Vector, Length
vdisex = VectorDisplayEx(Point=deplane.Origin, Vector=vec2pt.Vector, Colour=gradient_2, Width=Slider(1, range=0..45))

# ----
# level high
# Blue (above sea level)
gradient_3 = Gradient(
    LowerLimit=item,
    UpperLimit="-20",
    Parameter=pdecon.ZComponent,
    stops=[0.296: RGB(0, 128, 0), 0.585: RGB(0, 255, 0), 0.76: RGB(192, 255, 192), 0.887: RGB(173, 203, 249), 1: RGB(75, 107, 169)])
preview_2 = CustomPreview(Geometry=explode, Material=gradient_3)

# ----
# Contour
bbox = BoundingBox(Content=rebuild_mesh, Plane=PlaneXY(0, 0, 0))  # -> Box, Box_2
debrep = DeconstructBrep(Brep=bbox.Box)  # -> Faces, Edges, Vertices
item_2 = ListItem(List=debrep.Vertices, Index=3, Wrap=True)
level_curves_high = Slider(2, range=1..10)
contour = Contour(Shape=ggmeshtobrep, Point=item_2, Direction=Vector(0, 0, 1), Distance=level_curves_high)  # -> flatten(Contours)

panel_15 = Panel("Build Circular Habitat")
split = TextSplit(Text=deserialize_json_7.Type, Separators="_")
item_selector = ItemSelector(split)
pull_point = PullPoint(Point=habitat, Geometry=remove_ends.B_2, ClosestOnly=True)  # -> flatten(ClosestPoint), Distance
panel_16 = Panel("""10
15
20""")
panel_17 = Panel("""small
medium
large""")
keysearch = KeyValueSearch(Keys=panel_17, Values=panel_16, Search=item_selector)
cylinder = Cylinder(Base=pull_point.ClosestPoint, Radius=keysearch, Length="4")
cap_holes = CapHoles(Brep=cylinder)

panel_18 = Panel("Build rectangle Greenhouse")
split_2 = TextSplit(Text=deserialize_json_6.Type, Separators="_")
item_selector_2 = ItemSelector(split_2)
panel_19 = Panel("""small
medium
large""")
panel_20 = Panel("""7,15
15,35
20,60""")
keysearch_2 = KeyValueSearch(Keys=panel_19, Values=panel_20, Search=item_selector_2)
split_3 = TextSplit(Text=keysearch_2, Separators=",")
number_slider = Slider(0, range=0..10)
pull_point_2 = PullPoint(Point=greenhouse, Geometry=remove_ends.B_2, ClosestOnly=True)  # -> ClosestPoint, Distance
item_3 = ListItem(List=split_3, Index=0, Wrap=True)  # -> Item, Item1
vector_xyz = VectorXYZ(XComponent=number_slider, YComponent=number_slider, ZComponent=Slider(5.5, range=0..10))  # -> Vector, Length
rectangle = Rectangle(Plane=pull_point_2.ClosestPoint, XSize=item_3.Item, YSize=item_3.Item1, Radius=Slider(1, range=0..10))  # -> Rectangle, Length
extrude = Extrude(Base=rectangle.Rectangle, Direction=vector_xyz.Vector)
cap_holes_2 = CapHoles(Brep=extrude)

panel_21 = Panel("Bake")

# ----
# Cumulative radiation over a given period in kWh/m2
panel_22 = Panel("8")
gencumulativeskymtx = Ladybug_GenCumulativeSkyMtx(epwFile=epw_file, skyDensity=0, useOldRes=True, runIt=cumulative_radiation_over_a_given_period)  # -> readMe, cumulativeSkyMtx; disabled; plug-in component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
analysisperiod = Ladybug_AnalysisPeriod(fromMonth=panel_22, toMonth="9")  # -> out, analysisPeriod; plug-in component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
selectskymtx = Ladybug_selectSkyMtx(
    cumulativeSkyMtx=gencumulativeskymtx.cumulativeSkyMtx,
    analysisPeriod=analysisperiod.analysisPeriod,
    removeDiffuse=False,
    removeDirect=False)  # -> readMe, selectedSkyMtx; plug-in component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

# ---- group: make the mesh 3D
dom_3 = ConstructDomain(DomainStart=0, DomainEnd="1")

# ----
# Orient building optimally to the sun
# Highest
# Lowest
# Highest
# Lowest
number_slider_2 = Slider(0, range=0..10)
importepw = Ladybug_ImportEpw(epwFile=epw_file)  # -> Output, latitude, location, dryBulbTemperature, dewPointTemperature, relativeHumidity, windSpeed, windDirection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; plug-in component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
gencumulativeskymtx_2 = Ladybug_GenCumulativeSkyMtx(epwFile=epw_file, skyDensity=number_slider_2, useOldRes=True, runIt=orient_greenhouse)  # -> out, cumulativeSkyMtx; plug-in component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
sunpath = Ladybug_SunPath(location=importepw.location, hour=12, day=21, month=12, timeStep=1, dailyOrAnnualSunPath=True)  # -> out, sunVectors, sunAltitudes, sunAzimuths, port, sunSpheresMesh, sunPathCrvs, compassCrvs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; plug-in component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
orientationstudypar = Ladybug_OrientationStudyParameters(divisionAngle="60", totalAngle="360", runTheStudy=orient_greenhouse)  # -> orientationStudyPar; plug-in component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
selectskymtx_2 = Ladybug_selectSkyMtx(cumulativeSkyMtx=gencumulativeskymtx_2.cumulativeSkyMtx, removeDiffuse=False, removeDirect=False)  # -> readMe, selectedSkyMtx; plug-in component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
number_slider_3 = Slider(1, range=0..1)
slider = Slider(4, range=0..10)
radiationanalysis = Ladybug_RadiationAnalysis(
    geometry=flatten(cap_holes_2),
    context=flatten(contexte),
    gridSize=slider,
    disFromBase=number_slider_3,
    orientationStudyP=flatten(orientationstudypar),
    selectedSkyMtx=flatten(selectskymtx_2.selectedSkyMtx),
    parallel=orient_greenhouse,
    runIt=orient_greenhouse)  # -> out, contextMesh, analysisMesh, testPts, testVec, port, radiationResult, radiationMesh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; disabled; plug-in component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
sunlighthoursanalysis = Ladybug_SunlightHoursAnalysis(
    geometry=flatten(cap_holes_2),
    context=flatten(contexte),
    gridSize=slider,
    disFromBase=number_slider_3,
    orientationStudyP=flatten(orientationstudypar),
    sunVectors=flatten(sunpath.sunVectors),
    timeStep=1,
    parallel=orient_greenhouse,
    runIt=orient_greenhouse)  # -> out, contextMesh, analysisMesh, testPts, testVec, port, sunlightHoursResult, sunlightHoursMesh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; disabled; plug-in component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
sort_2 = SortList(Keys=radiationanalysis.totalRadiation)  # -> Keys, ValuesA
sort_3 = SortList(Keys=sunlighthoursanalysis.totalSunlightHours)  # -> Keys, ValuesA
rev = ReverseList(List=sort_2.Keys)
cset = CreateSet(List=sunlighthoursanalysis.totalSunlightHours)  # -> Set, Map
item_4 = ListItem(List=sort_3.Keys, Index="0", Wrap=True)
rev_2 = ReverseList(List=sort_3.Keys)
item_5 = ListItem(List=sort_2.Keys, Index="0", Wrap=True)
cset_2 = CreateSet(List=radiationanalysis.totalRadiation)  # -> Set, Map
item_6 = ListItem(List=rev_2, Index="0", Wrap=True)
mindex = MemberIndex(Set=cset.Set, Member=[item_6, item_4])  # -> Index, Count
item_7 = ListItem(List=rev, Index="0", Wrap=True)
mindex_2 = MemberIndex(Set=cset_2.Set, Member=[item_7, item_5])  # -> Index, Count
orientation_angles = Panel(mindex.Index)
orientation_angles_2 = Panel(mindex_2.Index)
item_selector_3 = ItemSelector(orientation_angles)
item_selector_4 = ItemSelector(orientation_angles_2)
multiplication = Multiplication(A=item_selector_3, B="60")
multiplication_2 = Multiplication(A=item_selector_4, B="60")
addition_4 = Addition(A=multiplication, B=multiplication_2)
division = Division(A=addition_4, B=Slider(2, range=0..10))
radians = Radians(Degrees=division)

center_of_mass = CenterOfMass(Geometry=cap_holes_2, Density=1)  # -> CenterOfMass, TotalVolume, TotalMass
panel_23 = Panel("Wind rose")
windrose = Ladybug_WindRose(
    north=0,
    hourlyWindDirection=importepw.windDirection,
    hourlyWindSpeed=importepw.windSpeed,
    centerPoint=center_of_mass.CenterOfMass,
    scale=Slider(0.5, range=-10..10),
    runIt=wind_rose)  # -> out, calmRoseMesh, windRoseMesh, windRoseCrvs, windRoseCenPts, legend, legendBasePts, title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; plug-in component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

rotate_3d = Rotate3D(Geometry=cap_holes_2, Angle=radians, Center=center_of_mass.CenterOfMass, Axis=Vector(0, 0, 1))  # -> Geometry, Transform

# ----
# ADJUST THE POSITION (slider are in meters)
deconstruct_brep = DeconstructBrep(Brep=rotate_3d.Geometry)  # -> Faces, Edges, Vertices
panel_24 = Panel("Build plant trays")
panel_25 = Panel("""side
top
bottom""")
keysearch_3 = KeyValueSearch(Keys=panel_25, Values=deconstruct_brep.Faces, Search="bottom")
deconstruct_brep_2 = DeconstructBrep(Brep=keysearch_3)  # -> Faces, Edges, Vertices
explode_2 = Explode(Curve=deconstruct_brep_2.Edges, Recursive=True)  # -> Segments, Vertices
list_item = ListItem(List=explode_2.Segments, Index="1", Wrap=True)
end_points = EndPoints(Curve=list_item)  # -> Start, End
vector_2pt = Vector2Pt(PointA=end_points.Start, PointB=end_points.End, Unitize=False)  # -> Vector, Length
align_plane = AlignPlane(Plane=deconstruct_brep_2.Faces, Direction=vector_2pt.Vector)  # -> Plane, Angle
number_slider_4 = Slider(1, range=0..10)
rectangle_2 = Rectangle(Plane=align_plane.Plane, XSize=number_slider_4, YSize=number_slider_4, Radius=0)  # -> Rectangle, Length
vector_xyz_2 = VectorXYZ(
    XComponent=Slider(-0.5, range=-100..100.001),
    YComponent=Slider(-0.5, range=-100..100.001),
    ZComponent=Slider(0.3, range=-100..100.001))  # -> Vector, Length
move = Move(Geometry=rectangle_2.Rectangle, Motion=vector_xyz_2.Vector)  # -> Geometry, Transform
box_rectangle = BoxRectangle(Rectangle=move.Geometry, Height=Slider(0.2, range=0..10))
number_slider_5 = Slider(0, range=0..10)
scale_nu = ScaleNU(
    Geometry=box_rectangle,
    Plane=PlaneXY(0, 0, 0),
    ScaleX=Slider(2, range=-100..100),
    ScaleY=Slider(2, range=-100..100),
    ScaleZ=Slider(2, range=-100..100))  # -> Geometry, Transform
vector_xyz_3 = VectorXYZ(XComponent=number_slider_5, YComponent=number_slider_5, ZComponent=Slider(0.7, range=0..10))  # -> Vector, Length
rectangular_array = RectangularArray(Geometry=box_rectangle, Cell=scale_nu.Geometry, XCount=Slider(6, range=-100..100), YCount=Slider(3, range=-100..100))  # -> Geometry, Transform
linear_array = LinearArray(Geometry=rectangular_array.Geometry, Direction=vector_xyz_3.Vector, Count=Slider(6, range=-100..100))  # -> Geometry, Transform

# ----
# Build tube between modules
brep_edges = BrepEdges(Brep=cap_holes)  # -> Naked, Interior, NonManifold
brep_edges_2 = BrepEdges(Brep=rotate_3d.Geometry)  # -> Naked, Interior, NonManifold
list_item_2 = ListItem(List=brep_edges.Interior, Index=0, Wrap=True)
explode_3 = Explode(Curve=list_item_2, Recursive=True)  # -> Segments, Vertices
explode_4 = Explode(Curve=brep_edges_2.Interior, Recursive=True)  # -> Segments, Vertices
list_item_3 = ListItem(List=explode_3.Vertices, Index=0, Wrap=True)
graft_tree = GraftTree(Tree=explode_4.Vertices, IncludeEmptyLists=True, IncludeNullItems=True)
center_of_mass_2 = CenterOfMass(Geometry=cap_holes, Density=1)  # -> CenterOfMass, TotalVolume, TotalMass
center_of_mass_3 = CenterOfMass(Geometry=rotate_3d.Geometry, Density=1)  # -> CenterOfMass, TotalVolume, TotalMass
tree_branch_index = TreeBranchIndex(DataTree=graft_tree, BranchIndex=Slider(15, range=0..100))
line = Line(StartPoint=list_item_3, EndPoint=center_of_mass_2.CenterOfMass)
line_2 = Line(StartPoint=center_of_mass_3.CenterOfMass, EndPoint=tree_branch_index)
evaluate_curve = EvaluateCurve(Curve=line_2, Parameter=Slider(0.5, range=0..100))  # -> Point, Tangent, Angle
evaluate_curve_2 = EvaluateCurve(Curve=line, Parameter=Slider(0.5, range=0..100))  # -> Point, Tangent, Angle
line_3 = Line(StartPoint=evaluate_curve.Point, EndPoint=evaluate_curve_2.Point)
pipe = Pipe(Curve=line_3, Radius=Slider(1, range=0..10), Caps=Slider(1, range=0..1))
solid_difference = SolidDifference(BrepsA=pipe, BrepsB=flatten([rotate_3d.Geometry, cap_holes]))
cap_holes_3 = CapHoles(Brep=solid_difference)
item_selector_5 = ItemSelector(cap_holes_3)

panel_26 = Panel("Electrical lines")
mesh_brep = MeshBrep(
    Brep=contexte,
    Settings={GridMaxCount=0, GridMinCount=16, JaggedSeams=False, MaxEdgeLength=0, MinEdgeLength=0.0001, MinTolerance=0, Refine=True, RefineAngle=0, RelativeTolerance=0.65, SimplePlanes=True, Tolerance=0})
radius = Panel("0.05")
greenhouse_connecti = Shortest_Walk(
    Person=center_of_mass_2.CenterOfMass,
    Interests=battery_storage,
    Obstacles=mesh_brep,
    Terrain=remove_ends.B_2,
    Sloping=Slider(160, range=0..1000))
shortest_walk = Shortest_Walk(
    Person=battery_storage,
    Interests=pv_array,
    Obstacles=mesh_brep,
    Terrain=remove_ends.B_2,
    Sloping=Slider(160, range=0..1000))
shortest_walk_2 = Shortest_Walk(
    Person=center_of_mass_3.CenterOfMass,
    Interests=battery_storage,
    Obstacles=mesh_brep,
    Terrain=remove_ends.B_2,
    Sloping=Slider(160, range=0..1000))
intcrv = Interpolate(Vertices=greenhouse_connecti, Degree=1, Periodic=False, KnotStyle=1)  # -> Curve, Length, Domain
intcrv_2 = Interpolate(Vertices=shortest_walk, Degree=1, Periodic=False, KnotStyle=1)  # -> Curve, Length, Domain
intcrv_3 = Interpolate(Vertices=shortest_walk_2, Degree=1, Periodic=False, KnotStyle=1)  # -> Curve, Length, Domain
smooth_polyline = SmoothPolyline(Polyline=intcrv.Curve, Strength=1, Times=1)
smooth_polyline_2 = SmoothPolyline(Polyline=intcrv_2.Curve, Strength=1, Times=1)
smooth_polyline_3 = SmoothPolyline(Polyline=intcrv_3.Curve, Strength=1, Times=1)
pipe_2 = Pipe(Curve=smooth_polyline, Radius=radius, Caps=0)
pipe_3 = Pipe(Curve=smooth_polyline_2, Radius=radius, Caps=0)
pipe_4 = Pipe(Curve=smooth_polyline_3, Radius=radius, Caps=0)

solid_difference_2 = SolidDifference(BrepsA=flatten(ggmeshtobrep), BrepsB=flatten([item_selector_5, rotate_3d.Geometry, cap_holes]))  # disabled

panel_27 = Panel("Build battery storage")
vector = Vector(Vector(-32.18003507, 0, 0))
vector_2 = Vector(Vector(0, 8.784883445, 0))
line_sdl = LineSDL(Start=battery_storage, Direction=vector, Length="0.46")
line_sdl_2 = LineSDL(Start=battery_storage, Direction=vector_2, Length="0.36")
square_root = SquareRoot(Value=deserialize_json_4.Amount)
control_points = ControlPoints(Curve=line_sdl_2)  # -> Points, Weights, Knots
control_points_2 = ControlPoints(Curve=line_sdl)  # -> Points, Weights, Knots
square_root_2 = SquareRoot(Value=square_root)
remove_ends_2 = NiceRemoveEnds(L=control_points.Points)  # -> A, B, B_2
remove_ends_3 = NiceRemoveEnds(L=control_points_2.Points)  # -> A, B, B_2
multiplication_3 = Multiplication(A=square_root_2, B=square_root_2)
vector_2pt_2 = Vector2Pt(PointA=remove_ends_2.A, PointB=remove_ends_2.B_2, Unitize=False)  # -> Vector, Length
vector_2pt_3 = Vector2Pt(PointA=remove_ends_3.A, PointB=remove_ends_3.B_2, Unitize=False)  # -> Vector, Length
number_slider_6 = Slider(0, range=0..10)
move_2 = Move(Geometry=line_sdl, Motion=vector_2pt_2.Vector)  # -> Geometry, Transform
move_3 = Move(Geometry=line_sdl_2, Motion=vector_2pt_3.Vector)  # -> Geometry, Transform
vector_xyz_4 = VectorXYZ(XComponent=number_slider_6, YComponent=number_slider_6, ZComponent=Slider(0.4, range=0..10))  # -> Vector, Length
boundary_surfaces = BoundarySurfaces(Edges=[line_sdl_2, line_sdl, move_3.Geometry, move_2.Geometry])
rectangular_array_2 = RectangularArray(Geometry=boundary_surfaces, Cell=boundary_surfaces, XCount=multiplication_3, YCount=square_root_2)  # -> Geometry, Transform

panel_28 = Panel("Build pv arrays")
vector_3 = Vector(Vector(-32.18003507, 0, 0))
vector_4 = Vector(Vector(0, 8.784883445, 0))
line_sdl_3 = LineSDL(Start=pv_array, Direction=vector_3, Length="0.46")
line_sdl_4 = LineSDL(Start=pv_array, Direction=vector_4, Length="0.36")
control_points_3 = ControlPoints(Curve=line_sdl_3)  # -> Points, Weights, Knots
control_points_4 = ControlPoints(Curve=line_sdl_4)  # -> Points, Weights, Knots
square_root_3 = SquareRoot(Value=deserialize_json_5.Amount)
remove_ends_4 = NiceRemoveEnds(L=control_points_4.Points)  # -> A, B, B_2
remove_ends_5 = NiceRemoveEnds(L=control_points_3.Points)  # -> A, B, B_2
round = Round(Number=square_root_3)  # -> Nearest, Floor, Ceiling
addition_5 = Addition(A=round.Nearest, B="1")
vector_2pt_4 = Vector2Pt(PointA=remove_ends_4.A, PointB=remove_ends_4.B_2, Unitize=False)  # -> Vector, Length
vector_2pt_5 = Vector2Pt(PointA=remove_ends_5.A, PointB=remove_ends_5.B_2, Unitize=False)  # -> Vector, Length
move_4 = Move(Geometry=line_sdl_3, Motion=vector_2pt_4.Vector)  # -> Geometry, Transform
move_5 = Move(Geometry=line_sdl_4, Motion=vector_2pt_5.Vector)  # -> Geometry, Transform
number_slider_7 = Slider(0.01, range=0..1)
vector_xyz_5 = VectorXYZ(XComponent=number_slider_7, YComponent=number_slider_7, ZComponent=number_slider_7)  # -> Vector, Length
boundary_surfaces_2 = BoundarySurfaces(Edges=[line_sdl_4, line_sdl_3, move_5.Geometry, move_4.Geometry])
center = Center(Geometry=boundary_surfaces_2)  # -> Center, Dimension
scale = Scale(Geometry=boundary_surfaces_2, Center=center.Center, Factor="1.5")  # -> Geometry, Transform

panel_29 = Panel("Orient solar PV")
tof = Ladybug_TiltAndOrientationFactor(
    epwFile=epw_file,
    PV_SWHsurface=boundary_surfaces_2,
    annualShading=0,
    north=0,
    precision="6",
    scale=1,
    bakeIt=False,
    runIt=orient_solar_array)  # -> out, port, TOF, TSRF, PVsurfaceTilt, PVsurfaceAzimuth, optimalTilt, optimalAzimuth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; plug-in component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
legend = Mesh(tof.legend)
line_sdl_5 = LineSDL(Start=pv_array, Direction=Vector(0, 0, 1), Length=1)
multiplication_4 = Multiplication(A=tof.PVsurfaceTilt, B="+1")
rotate_axis = RotateAxis(Geometry=boundary_surfaces_2, Angle=tof.PVsurfaceAzimuth, Axis=line_sdl_5)  # -> Geometry, Transform
brep_wireframe = BrepWireframe(Brep=rotate_axis.Geometry, Density=-1)
explode_5 = Explode(Curve=brep_wireframe, Recursive=True)  # -> Segments, Vertices
item_selector_6 = ItemSelector(explode_5.Segments)
rotate_axis_2 = RotateAxis(Geometry=rotate_axis.Geometry, Angle=multiplication_4, Axis=item_selector_6)  # -> Geometry, Transform

rectangular_array_3 = RectangularArray(Geometry=rotate_axis_2.Geometry, Cell=scale.Geometry, XCount=round.Nearest, YCount=addition_5)  # -> Geometry, Transform
extrude_2 = Extrude(Base=rectangular_array_3.Geometry, Direction=vector_xyz_5.Vector)

# ----
# Layout on the surface
solid_union = SolidUnion(Breps=rectangular_array_2.Geometry)
thickness = Slider(0.05, range=0..5)
modules_to_be_excluded_if_obstacle = Slider(2, range=0..10)
reference_height = Slider(25, range=0..100)
riser_height = Slider(0.1, range=0..2)
explode_6 = BRepComponents(Brep=solid_union)  # -> Faces, Edges, Vertices
graft = GraftTree(Data=explode_6.Faces, Strip=False)
curvepoint = PointOnCurve(explode_6.Edges, parameter=0.5)
brep_cp = BRepCP(Point=curvepoint, BRep=graft, DataComparison="cross_reference")  # -> Point, Distance
flip = FlipMatrix(Data=brep_cp.Distance)
smaller = SmallerThan(FirstNumber=flip, SecondNumber="0.1")  # -> SmallerThan, OrEqualTo
ma = MassAddition(Input=smaller.SmallerThan)  # -> Result, PartialResult
flatten = FlattenTree(Data=ma.Result, Path="{0}")
equals = Equality(FirstNumber=flatten, SecondNumber="1")  # -> Equality, Inequality
cull = CullPattern(List=explode_6.Edges, CullPattern=equals.Equality)
join = JoinCurves(Curves=cull, Preserve=False)
dim = Dimensions(Surface=join)  # -> UDimension, VDimension
division_2 = Division(A=dim.UDimension, B="0.36")
division_3 = Division(A=dim.VDimension, B="0.46")
round_2 = Round(Number=division_2)  # -> Nearest, Floor, Ceiling
round_3 = Round(Number=division_3)  # -> Nearest, Floor, Ceiling
planar = Planar(Curve=join)  # -> Planar, Plane, Deviation
recgrid = Rectangular(Plane=planar.Plane, SizeX="0.36", SizeY="0.46", ExtentX=round_2.Nearest, ExtentY=round_3.Nearest)  # -> Cells, Points
Z = UnitZ(Factor=reference_height)
move_6 = Move(Geometry=recgrid.Cells, Motion=Z)  # -> Geometry, Transform
cp = ControlPoints(Curve=move_6.Geometry)  # -> Points, Weights, Knots
Z_2 = UnitZ(Factor=-100)
project_2 = ProjectPoint(Point=cp.Points, Direction=Z_2, Geometry=ggmeshtobrep)  # -> Point, Index
pt = Point(project_2.Point)
dist = Distance(PointA=cp.Points, PointB=pt)
null = NullItem(Item=dist)  # -> NullFlags, InvalidFlags, Description
dispatch = Dispatch(List=dist, DispatchPattern=null.NullFlags)  # -> ListA, ListB
sort_4 = SortList(Keys=dispatch.ListB)  # -> Keys, ValuesA
item_8 = ListItem(List=sort_4.Keys, Index=0, Wrap=True)
trim = TrimTree(Tree=item_8, Depth=1)
division_4 = Division(A=trim, B=riser_height)
round_4 = Round(Number=division_4)  # -> Nearest, Floor, Ceiling
multiplication_5 = Multiplication(A=round_4.Floor, B=riser_height)
Z_3 = UnitZ(Factor=expr("-x", multiplication_5))
area = Area(Geometry=obstacle)  # -> Area, Centroid
move_7 = Move(Geometry=move_6.Geometry, Motion=Z_3)  # -> Geometry, Transform
project_3 = ProjectPoint(Point=area.Centroid, Direction=Vector(0, 0, -1), Geometry=ggmeshtobrep)  # -> Point, Index
Z_4 = UnitZ(Factor=thickness)
boundary = BoundarySurfaces(Edges=move_7.Geometry)
area_2 = Area(Geometry=boundary)  # -> Area, flatten(Centroid)
extr = Extrude(Base=boundary, Direction=Z_4)  # -> flatten(Extrusion)
cps = ClosestPoints(Point=project_3.Point, Cloud=area_2.Centroid, Count=modules_to_be_excluded_if_obstacle)  # -> flatten(ClosestPoint), flatten(CPIndex), Distance
cull_i = CullIndex(List=extr, Indices=cps.CPIndex, Wrap=True)

linear_array_2 = LinearArray(Geometry=cull_i, Direction=vector_xyz_4.Vector, Count=square_root_2)  # -> Geometry, Transform

# ----
# Layout on the surface
solid_union_2 = SolidUnion(Breps=extrude_2)
explode_7 = BRepComponents(Brep=solid_union_2)  # -> Faces, Edges, Vertices
join_2 = JoinCurves(Curves=explode_7.Edges, Preserve=False)
dim_2 = Dimensions(Surface=join_2)  # -> UDimension, VDimension
division_5 = Division(A=dim_2.UDimension, B="0.36")
division_6 = Division(A=dim_2.VDimension, B="0.46")
round_5 = Round(Number=division_5)  # -> Nearest, Floor, Ceiling
round_6 = Round(Number=division_6)  # -> Nearest, Floor, Ceiling
planar_2 = Planar(Curve=join_2)  # -> Planar, Plane, Deviation
recgrid_2 = Rectangular(Plane=planar_2.Plane, SizeX="0.36", SizeY="0.46", ExtentX=round_5.Nearest, ExtentY=round_6.Nearest)  # -> Cells, Points
Z_5 = UnitZ(Factor=reference_height)
move_8 = Move(Geometry=recgrid_2.Cells, Motion=Z_5)  # -> Geometry, Transform
cp_2 = ControlPoints(Curve=move_8.Geometry)  # -> Points, Weights, Knots
Z_6 = UnitZ(Factor=-100)
project_4 = ProjectPoint(Point=cp_2.Points, Direction=Z_6, Geometry=ggmeshtobrep)  # -> Point, Index
pt_2 = Point(project_4.Point)
dist_2 = Distance(PointA=cp_2.Points, PointB=pt_2)
null_2 = NullItem(Item=dist_2)  # -> NullFlags, InvalidFlags, Description
dispatch_2 = Dispatch(List=dist_2, DispatchPattern=null_2.NullFlags)  # -> ListA, ListB
sort_5 = SortList(Keys=dispatch_2.ListB)  # -> Keys, ValuesA
item_9 = ListItem(List=sort_5.Keys, Index=0, Wrap=True)
trim_2 = TrimTree(Tree=item_9, Depth=1)
division_7 = Division(A=trim_2, B=riser_height)
round_7 = Round(Number=division_7)  # -> Nearest, Floor, Ceiling
multiplication_6 = Multiplication(A=round_7.Floor, B=riser_height)
Z_7 = UnitZ(Factor=expr("-x", multiplication_6))
area_3 = Area(Geometry=obstacle)  # -> Area, Centroid
move_9 = Move(Geometry=move_8.Geometry, Motion=Z_7)  # -> Geometry, Transform
project_5 = ProjectPoint(Point=area_3.Centroid, Direction=Vector(0, 0, -1), Geometry=ggmeshtobrep)  # -> Point, Index
Z_8 = UnitZ(Factor=thickness)
boundary_2 = BoundarySurfaces(Edges=move_9.Geometry)
area_4 = Area(Geometry=boundary_2)  # -> Area, flatten(Centroid)
extr_2 = Extrude(Base=boundary_2, Direction=Z_8)  # -> flatten(Extrusion)
cps_2 = ClosestPoints(Point=project_5.Point, Cloud=area_4.Centroid, Count=modules_to_be_excluded_if_obstacle)  # -> flatten(ClosestPoint), flatten(CPIndex), Distance
cull_i_2 = CullIndex(List=extr_2, Indices=cps_2.CPIndex, Wrap=True)

brep = Brep(flatten([rotate_3d.Geometry, item_selector_5, cull_i_2, pipe_2, pipe_3, pipe_4, cap_holes, linear_array.Geometry, linear_array_2.Geometry]))

radiationanalysis_2 = Ladybug_RadiationAnalysis(
    geometry=flatten(ggmeshtobrep),
    context=flatten(brep),
    gridSize=Slider(2, range=0..10),
    disFromBase=Slider(0.001, range=0..0.001),
    selectedSkyMtx=flatten(selectskymtx.selectedSkyMtx),
    parallel=cumulative_radiation_over_a_given_period,
    runIt=cumulative_radiation_over_a_given_period)  # -> readMe, contextMesh, analysisMesh, testPts, testVec, port, radiationResult, radiationMesh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; disabled; plug-in component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
recolormesh = Ladybug_RecolorMesh(
    analysisResult=radiationanalysis_2.radiationResult,
    inputMesh=radiationanalysis_2.radiationMesh,
    heightDomain=dom_3,
    analysisTitle="Cumulative Radiation Analysis",
    legendTitle="kWh/m2")  # -> readMe, newMesh, newLegend, legendBasePt, meshColors, legendColors; plug-in component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

# ==== cluster NiceRemoveEnds: Removes a list's start and end
L = ClusterInput()
lng = ListLength(List=L)
split = SplitList(List=L, Index=expr("x-1", lng))  # -> ListA, flatten(ListB)
split_2 = SplitList(List=split.ListA, Index=1)  # -> flatten(ListA), flatten(ListB)
A = ClusterOutput(split_2.ListA)
B = ClusterOutput(split_2.ListB)
B_2 = ClusterOutput(split.ListB)
